# Grasshopper definition 00_basics.gh (Grasshopper 0.9.76)
# plug-ins: Python Interpreter

# ---- group: generation of the voxel field
number_slider = Slider(1.5, range=0..10)
box = DomainBox(Base=PlaneXY(0, 0, 0), X="0 to 50", Y="0 to 40", Z="0 to 30")
frepvoxelgrid = FRepVoxelGrid(box=box, dim=number_slider)  # -> wbox, nx, ny, nz, pts

# ---- group: construct csg tree
pt = Point(Point(20, 10, 11.93476714))
pt_2 = Point(Point(30, 24.69909686, 13.17037201))
frepsphere = FRepSphere(center=pt_2, radius=Slider(10, range=0..20), pts=frepvoxelgrid.pts)  # -> out, a; inputs center: Point3d, pts: list of Point3d
# ---------- frepsphere: Python ----------
#!/usr/bin/env python2
# -*- coding: utf-8 -*-

__author__     = ['Mathias Bernhard']
__copyright__  = 'Copyright 2018 / Digital Building Technologies DBT / ETH Zurich'
__license__    = 'MIT License'
__email__      = '<bernhard@arch.ethz.ch>'

import rhinoscriptsyntax as rs

a = [rs.Distance(center,p)-radius for p in pts]
# ---------- end frepsphere ----------
freptorus = FRepTorus(center=pt, radius_a=Slider(20, range=0..20), radius_b=Slider(3, range=0..20), pts=frepvoxelgrid.pts)  # -> out, a; inputs center: Point3d, pts: list of Point3d
# ---------- freptorus: Python ----------
#!/usr/bin/env python2
# -*- coding: utf-8 -*-

"""
Creates a Torus
Inputs:
    center: The center point of the torus
    radius_a: Radius from center to axis
    radius_b: Radius of pipe around axis
    pts: List of points to query
Output:
    a: Distance values for all points in pts
"""

__author__     = ['Mathias Bernhard']
__copyright__  = 'Copyright 2018 / Digital Building Technologies DBT / ETH Zurich'
__license__    = 'MIT License'
__email__      = '<bernhard@arch.ethz.ch>'

import rhinoscriptsyntax as rs
import math

def get_dist(p):
    lxy = math.sqrt(math.pow(center[0]-p[0],2) + math.pow(center[1]-p[1],2))
    l2  = math.sqrt(math.pow(lxy-radius_a,2) + math.pow(center[2]-p[2],2))
    return l2-radius_b

a = [get_dist(p) for p in pts]
# ---------- end freptorus ----------
frepsubtraction = FRepSubtraction(A=frepsphere.a, B=freptorus.a)  # -> out, a; inputs A: list, B: list
# ---------- frepsubtraction: Python ----------
#!/usr/bin/env python2
# -*- coding: utf-8 -*-

__author__     = ['Mathias Bernhard']
__copyright__  = 'Copyright 2018 / Digital Building Technologies DBT / ETH Zurich'
__license__    = 'MIT License'
__email__      = '<bernhard@arch.ethz.ch>'

a = [max(t[0],-t[1]) for t in zip(A,B)]
# ---------- end frepsubtraction ----------

# ---- group: isosurface mesh generation
frepisosurface = FRepIsosurface(box=frepvoxelgrid.wbox, a=frepsubtraction.a, nx=frepvoxelgrid.nx, ny=frepvoxelgrid.ny, nz=frepvoxelgrid.nz)  # -> out, A; inputs box: Box, a: list of Double, nx: Int32, ny: Int32, nz: Int32
# ---------- frepisosurface: C# ----------
    Mesh m = marchingCubesMesh(nx, ny, nz, a, 0.0);
    double dx = box.X[1] - box.X[0];
    double dy = box.Y[1] - box.Y[0];
    double dz = box.Z[1] - box.Z[0];
    m.Scale(dx / nx);
    // todo: box transform (non-uniform scale, translation)
    A = m;
# ---------- frepisosurface: C# additional code ----------
  public Mesh marchingCubesMesh(int nX, int nY, int nZ, List<double> values, double iso) {
    Mesh mesh = new Mesh();
    int nYZ = nY * nZ;
    int nVs = 0;
    int index = 0;
    double[] nbs = new double[8];
    int[] edges = new int[12];
    int[,] xEdges = new int[nY, nZ];
    int[,] yEdges = new int[nY, nZ];
    int[,] zEdges = new int[nY, nZ];
    int[,] yEdgesUp = new int[nY, nZ];
    int[,] zEdgesUp = new int[nY, nZ];

    // first pass: all have to be calculated
    // second pass: 2 becomes 1

    for (int x = 0; x < nX - 1; x++) {
      if (x == 0) {
        for (int y = 0; y < nY; y++) {
          for (int z = 0; z < nZ; z++) {
            index = z + y * nZ + x * nYZ;
            double cV = values[index];

            if (y < nY - 1) {
              double yNb = values[index + nZ];
              if (isBorder(cV, yNb, iso)) {
                mesh.Vertices.Add(x, getValue(iso, cV, yNb) + y, z);
                yEdges[y, z] = nVs;
                nVs++;
              }
            }
            if (z < nZ - 1) {
              double zNb = values[index + 1];
              if (isBorder(cV, zNb, iso)) {
                mesh.Vertices.Add(x, y, getValue(iso, cV, zNb) + z);
                zEdges[y, z] = nVs;
                nVs++;
              }
            }
          }
        }
      } else {
        // collecting the Vertices and Edges
        copyValuesFromAToB(yEdgesUp, yEdges);
        copyValuesFromAToB(zEdgesUp, zEdges);
      }
      for (int y = 0; y < nY; y++) {
        for (int z = 0; z < nZ; z++) {
          index = z + y * nZ + x * nYZ;
          double cV = values[index];

          double xNb = values[index + nYZ];
          if (isBorder(cV, xNb, iso)) {
            mesh.Vertices.Add(getValue(iso, cV, xNb) + x, y, z);
            xEdges[y, z] = nVs;
            nVs++;
          }

          index += nYZ;
          cV = values[index];

          if (y < nY - 1) {
            double yNb = values[index + nZ];
            if (isBorder(cV, yNb, iso)) {
              mesh.Vertices.Add(x + 1, getValue(iso, cV, yNb) + y, z);
              yEdgesUp[y, z] = nVs;
              nVs++;
            }
          }
          if (z < nZ - 1) {
            double zNb = values[index + 1];
            if (isBorder(cV, zNb, iso)) {
              mesh.Vertices.Add(x + 1, y, getValue(iso, cV, zNb) + z);
              zEdgesUp[y, z] = nVs;
              nVs++;
            }
          }
        }
      }

      // collecting the faces
      for (int y = 0; y < nY - 1; y++) {
        for (int z = 0; z < nZ - 1; z++) {
          int caseNumber = 0;
          index = z + y * nZ + x * nYZ;
          nbs[0] = values[index + nZ];
          nbs[1] = values[index + nYZ + nZ];
          nbs[2] = values[index + nYZ];
          nbs[3] = values[index];
          nbs[4] = values[index + nZ + 1];
          nbs[5] = values[index + nYZ + nZ + 1];
          nbs[6] = values[index + nYZ + 1];
          nbs[7] = values[index + 1];
          for (int i = 7; i > -1; i--) {
            if (nbs[i] > iso) {
              caseNumber++;
            }
            if (i > 0) {
              caseNumber = caseNumber << 1;
            }
          }

          edges[0] = xEdges[y + 1, z];
          edges[1] = yEdgesUp[y, z];
          edges[2] = xEdges[y, z];
          edges[3] = yEdges[y, z];

          edges[4] = xEdges[y + 1, z + 1];
          edges[5] = yEdgesUp[y, z + 1];
          edges[6] = xEdges[y, z + 1];
          edges[7] = yEdges[y, z + 1];

          edges[8] = zEdges[y + 1, z];
          edges[9] = zEdgesUp[y + 1, z];
          edges[10] = zEdges[y, z];
          edges[11] = zEdgesUp[y, z];

          int offset = caseNumber * 15;

          for (int i = offset; i < offset + 15; i += 3) {
            if (faces[i] > -1) {
              MeshFace fc = new MeshFace();

              fc.A = edges[faces[i + 0]];
              fc.B = edges[faces[i + 1]];
              fc.C = edges[faces[i + 2]];
              fc.D = fc.C;
              if (fc.IsTriangle){
                mesh.Faces.AddFace(fc);
              }
            }
          }
        }
      }
    }
    mesh.Normals.ComputeNormals();
    mesh.Compact();
    return mesh;
  }

  private void copyValuesFromAToB(int[,] array1, int[,] array2) {
    for (int i = 0; i < array1.GetLength(0); i++) {
      for (int j = 0; j < array1.GetLength(1); j++) {
        array2[i, j] = array1[i, j];
      }
    }
  }

  private double getValue(double iso, double v1, double v2) {
    if (Math.Abs(v2 - v1) < 0.0000001f) {
      return 0;
    }
    return (iso - v1) / (v2 - v1);
  }

  private bool isBorder(double v1, double v2, double iso){
    if (v1 > iso && v2 <= iso)return true;
    if (v2 > iso && v1 <= iso)return true;
    return false;
  }

  private static int[] faces = new int[] {
    -1, -1, -1, -1, -1, -1, -1, -1, -1, -1, -1,-1, -1, -1, -1,
    0, 8, 3, -1, -1, -1, -1, -1, -1, -1, -1, -1, -1,-1, -1,
    0, 1, 9, -1, -1, -1, -1, -1, -1, -1, -1, -1, -1, -1, -1,
    1,8, 3, 9, 8, 1, -1, -1, -1, -1, -1, -1, -1, -1, -1,
    1, 2, 11, -1,-1, -1, -1, -1, -1, -1, -1, -1, -1, -1, -1,
    0, 8, 3, 1, 2, 11, -1,-1, -1, -1, -1, -1, -1, -1, -1,
    9, 2, 11, 0, 2, 9, -1, -1, -1, -1,
    -1, -1, -1, -1, -1, 2, 8, 3, 2, 11, 8, 11, 9, 8, -1, -1, -1, -1,
    -1, -1, 3, 10, 2, -1, -1, -1, -1, -1, -1, -1, -1, -1, -1, -1, -1,
    0, 10, 2, 8, 10, 0, -1, -1, -1, -1, -1, -1, -1, -1, -1, 1, 9, 0, 2,
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# ---------- end frepisosurface ----------
preview = CustomPreview(Geometry=frepisosurface.A, Shader=ColourSwatch(SwatchColor=RGB(252, 108, 133)))

# ---- group: volumetric display of distance field
freplistrange = FRepListrange(a=frepsubtraction.a)  # -> out, v_min, v_max, v; inputs a: list
# ---------- freplistrange: Python ----------
#!/usr/bin/env python2
# -*- coding: utf-8 -*-

__author__     = ['Mathias Bernhard']
__copyright__  = 'Copyright 2018 / Digital Building Technologies DBT / ETH Zurich'
__license__    = 'MIT License'
__email__      = '<bernhard@arch.ethz.ch>'

v_min = min(a)
v_max = max(a)
v = a
# ---------- end freplistrange ----------
gradient = Gradient(
    LowerLimit=freplistrange.v_min,
    UpperLimit=freplistrange.v_max,
    Parameter=freplistrange.v,
    stops=[0: RGB(243, 57, 0), 0.1: RGB(236, 27, 60), 0.2: RGB(210, 0, 118), 0.3: RGB(103, 0, 120), 0.4: RGB(39, 72, 161), 0.5: RGB(1, 192, 229), 0.6: RGB(18, 178, 90), 0.7: RGB(79, 186, 8), 0.8: RGB(220, 237, 32), 0.9: RGB(247, 159, 20), 1: RGB(243, 57, 0)])
division = Division(A=number_slider, B="3.0")
dots = DotDisplay(Point=frepvoxelgrid.pts, Colour=gradient, Size=division)

# ==== cluster FRepVoxelGrid: Creates the initial grid of voxels. Outputs number of cells in X, Y and Z and a list of query points.
box = ClusterInput()
box_corners = BoxCorners(Box=box)  # -> CornerA, CornerB, CornerC, CornerD, CornerE, CornerF, CornerG, CornerH
bbox = BoundingBox(
    Content=[box_corners.CornerA, box_corners.CornerB, box_corners.CornerC, box_corners.CornerD, box_corners.CornerE, box_corners.CornerF, box_corners.CornerG, box_corners.CornerH],
    Plane=PlaneXY(0, 0, 0),
    UnionBox=True)  # -> wBox, B
dim = ClusterInput()
c_script = CSharpScript(Box=bbox.wBox, dim=dim)  # -> out, nx, ny, nz, pts; inputs Box: Box, dim: Double
# ---------- c_script: C# ----------
    double dx = Box.X[1] - Box.X[0];
    double dy = Box.Y[1] - Box.Y[0];
    double dz = Box.Z[1] - Box.Z[0];

    int nxt = (int) Math.Round(dx / dim);
    int nyt = (int) Math.Round(dy / dim);
    int nzt = (int) Math.Round(dz / dim);

    double dimx = dx / nxt;
    double dimy = dy / nyt;
    double dimz = dz / nzt;

    nx = nxt;
    ny = nyt;
    nz = nzt;

    Point3d[] res = new Point3d[nxt * nyt * nzt];
    int i = 0;
    for (int x = 0; x < nxt; x++) {
      for (int y = 0; y < nyt; y++) {
        for (int z = 0; z < nzt; z++) {
          double px = dimx / 2 + Box.Center[0] - dx / 2 + x * dimx;
          double py = dimy / 2 + Box.Center[1] - dy / 2 + y * dimy;
          double pz = dimz / 2 + Box.Center[2] - dz / 2 + z * dimz;
          res[i] = new Point3d(px, py, pz);
          i++;
        }
      }
    }
    pts = res;
# ---------- c_script: C# additional code ----------
  /// <summary>
  /// This method will be called once every solution, before any calls to RunScript.
  /// </summary>
  public override void BeforeRunScript()
  { }
  /// <summary>
  /// This method will be called once every solution, after any calls to RunScript.
  /// </summary>
  public override void AfterRunScript()
  { }
# ---------- end c_script ----------
wbox = ClusterOutput(bbox.wBox)
nx = ClusterOutput(c_script.nx)
ny = ClusterOutput(c_script.ny)
nz = ClusterOutput(c_script.nz)
pts = ClusterOutput(c_script.pts)
