# Grasshopper definition 01_landscape.gh (Grasshopper 0.9.76)
# plug-ins: Python Interpreter

# ---- group: generate voxel space from heightmap
panel = Panel("path\to\heightmap\terrain_small.png")
path = FilePath()
freplandscape = FRepLandscape(filepath=path)  # -> out, nx, ny, nz, pts, a
# ---------- freplandscape: Python ----------
#!/usr/bin/env python2
# -*- coding: utf-8 -*-

"""
Creates a VoxelSpace from an image (heightmap) located at <filepath>.
"""

__author__     = ['Mathias Bernhard']
__copyright__  = 'Copyright 2018 / Digital Building Technologies DBT / ETH Zurich'
__license__    = 'MIT License'
__email__      = '<bernhard@arch.ethz.ch>'

import System
import rhinoscriptsyntax as rs

path = filepath

bitmap = System.Drawing.Bitmap.FromFile(path)
nx = bitmap.Width
ny = bitmap.Height
nz = 20

a = []
for x in xrange(nx):
    for y in xrange(ny):
        color = System.Drawing.Bitmap.GetPixel(bitmap, x,ny-1-y)
        for z in xrange(nz):
            val = color.R/255.0
            val -= 0.5
            val *= 18
            val = z-nz/2.0-val
            a.append(val)
            
pts = [rs.AddPoint(x,y,z) for x in range(nx) for y in range(ny) for z in range(nz)]
# ---------- end freplandscape ----------
box = DomainBox(Base=PlaneXY(0, 0, 0), X="0 to 80", Y="0 to 60", Z="0 to 20")

# ---- group: dig tunnel
crv = Curve(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)
freppipe = FRepPipe(axis=crv, start_radius=Slider(3, range=0..10), pts=freplandscape.pts)  # -> out, a; inputs axis: list of Curve, start_radius: list, end_radius: list, pts: list of Point3d
# ---------- freppipe: Python ----------
#!/usr/bin/env python2
# -*- coding: utf-8 -*-

"""
Creates circular pipes along one or multiple curve(s).
If only one radius is specified, it is used for all the curves.
If no end radius is specified, the start radius is used.
"""

__author__     = ['Mathias Bernhard']
__copyright__  = 'Copyright 2018 / Digital Building Technologies DBT / ETH Zurich'
__license__    = 'MIT License'
__email__      = '<bernhard@arch.ethz.ch>'

import rhinoscriptsyntax as rs
import math

def map_values(input_val, in_from, in_to, out_from, out_to):
    out_range = out_to - out_from
    in_range = in_to - in_from
    in_val = input_val - in_from
    val=(float(in_val)/in_range)*out_range
    out_val = out_from+val
    return out_val

def get_dist(p,j):
    param=rs.CurveClosestPoint(axis[j], p)
    cp=rs.EvaluateCurve(axis[j],param)
    dv = map_values(param,axis[j].Domain[0],axis[j].Domain[1],0,1)
    r = (1-dv)*start_radius[j] + dv*end_radius[j]
    d = rs.Distance(p,cp) - r
    return d

if __name__ == "__main__":
    # check inputs
    if not start_radius:
        start_radius = [5.0 for _ in axis]
    if not end_radius:
        end_radius = [r for r in start_radius]
    if len(start_radius)<len(axis):
        start_radius = [start_radius[0] for _ in axis]
    if len(end_radius)<len(axis):
        end_radius = [end_radius[0] for _ in axis]
        
    # calculate distances
    a = [9999.9 for p in pts]
    for j,c in enumerate(axis):
        a = [min(a[i],get_dist(p,j)) for i,p in enumerate(pts)]
# ---------- end freppipe ----------
frepsubtraction = FRepSubtraction(A=freplandscape.a, B=freppipe.a)  # -> out, a; inputs A: list, B: list
# ---------- frepsubtraction: Python ----------
#!/usr/bin/env python2
# -*- coding: utf-8 -*-

__author__     = ['Mathias Bernhard']
__copyright__  = 'Copyright 2018 / Digital Building Technologies DBT / ETH Zurich'
__license__    = 'MIT License'
__email__      = '<bernhard@arch.ethz.ch>'

a = [max(t[0],-t[1]) for t in zip(A,B)]
# ---------- end frepsubtraction ----------

# ---- group: create tunnel walls and bridges
pt = Point(<point referenced from the Rhino model>)
frepbox = FRepBox(center=pt, L="80", B="80", H="10", fillet_radius=0, pts=freplandscape.pts)  # -> out, a; inputs center: Point3d, pts: list of Point3d
# ---------- frepbox: Python ----------
#!/usr/bin/env python2
# -*- coding: utf-8 -*-

__author__     = ['Mathias Bernhard']
__copyright__  = 'Copyright 2018 / Digital Building Technologies DBT / ETH Zurich'
__license__    = 'MIT License'
__email__      = '<bernhard@arch.ethz.ch>'

import rhinoscriptsyntax as rs
import math

def get_dist(p):
    dx = abs(p[0]-center[0]) - (L/2-fillet_radius)
    dy = abs(p[1]-center[1]) - (B/2-fillet_radius)
    dz = abs(p[2]-center[2]) - (H/2-fillet_radius)
    inside = max(dx,max(dy,dz)) - fillet_radius
    dx = max(dx,0)
    dy = max(dy,0)
    dz = max(dz,0)
    corner = math.pow(dx*dx + dy*dy + dz*dz,0.5) - fillet_radius
    if inside+fillet_radius>0:
        return corner
    else:
        return inside
    
if __name__ == '__main__':
    a = [get_dist(p) for p in pts]
# ---------- end frepbox ----------
frepshell = FRepShell(vals=freppipe.a, thickness=Slider(1, range=0..2), side=0)  # -> out, a; inputs vals: list
# ---------- frepshell: Python ----------
#!/usr/bin/env python2
# -*- coding: utf-8 -*-
"""
Creates a shell from the solid object. Thickness and position (inside/outside) can be varied.
"""

__author__     = ['Mathias Bernhard']
__copyright__  = 'Copyright 2018 / Digital Building Technologies DBT / ETH Zurich'
__license__    = 'MIT License'
__email__      = '<bernhard@arch.ethz.ch>'

a = [abs(v + (side-0.5)*thickness) - thickness/2 for v in vals]
# ---------- end frepshell ----------
frepsubtraction_2 = FRepSubtraction(A=frepshell.a, B=frepbox.a)  # -> out, a; inputs A: list, B: list; same code as frepsubtraction

# ----
frepunion = FRepUnion(A=frepsubtraction.a, B=frepsubtraction_2.a)  # -> out, a; inputs A: list, B: list
# ---------- frepunion: Python ----------
#!/usr/bin/env python2
# -*- coding: utf-8 -*-

__author__     = ['Mathias Bernhard']
__copyright__  = 'Copyright 2018 / Digital Building Technologies DBT / ETH Zurich'
__license__    = 'MIT License'
__email__      = '<bernhard@arch.ethz.ch>'

a = [min(t) for t in zip(A,B)]
# ---------- end frepunion ----------

# ---- group: isosurface mesh generation
frepisosurface = FRepIsosurface(box=box, a=frepunion.a, nx=freplandscape.nx, ny=freplandscape.ny, nz=freplandscape.nz)  # -> out, A; inputs box: Box, a: list of Double, nx: Int32, ny: Int32, nz: Int32
# ---------- frepisosurface: C# ----------
    Mesh m = marchingCubesMesh(nx, ny, nz, a, 0.0);
    double dx = box.X[1] - box.X[0];
    double dy = box.Y[1] - box.Y[0];
    double dz = box.Z[1] - box.Z[0];
    m.Scale(dx / nx);
    // todo: box transform (non-uniform scale, translation)
    A = m;
# ---------- frepisosurface: C# additional code ----------
  public Mesh marchingCubesMesh(int nX, int nY, int nZ, List<double> values, double iso) {
    Mesh mesh = new Mesh();
    int nYZ = nY * nZ;
    int nVs = 0;
    int index = 0;
    double[] nbs = new double[8];
    int[] edges = new int[12];
    int[,] xEdges = new int[nY, nZ];
    int[,] yEdges = new int[nY, nZ];
    int[,] zEdges = new int[nY, nZ];
    int[,] yEdgesUp = new int[nY, nZ];
    int[,] zEdgesUp = new int[nY, nZ];

    // first pass: all have to be calculated
    // second pass: 2 becomes 1

    for (int x = 0; x < nX - 1; x++) {
      if (x == 0) {
        for (int y = 0; y < nY; y++) {
          for (int z = 0; z < nZ; z++) {
            index = z + y * nZ + x * nYZ;
            double cV = values[index];

            if (y < nY - 1) {
              double yNb = values[index + nZ];
              if (isBorder(cV, yNb, iso)) {
                mesh.Vertices.Add(x, getValue(iso, cV, yNb) + y, z);
                yEdges[y, z] = nVs;
                nVs++;
              }
            }
            if (z < nZ - 1) {
              double zNb = values[index + 1];
              if (isBorder(cV, zNb, iso)) {
                mesh.Vertices.Add(x, y, getValue(iso, cV, zNb) + z);
                zEdges[y, z] = nVs;
                nVs++;
              }
            }
          }
        }
      } else {
        // collecting the Vertices and Edges
        copyValuesFromAToB(yEdgesUp, yEdges);
        copyValuesFromAToB(zEdgesUp, zEdges);
      }
      for (int y = 0; y < nY; y++) {
        for (int z = 0; z < nZ; z++) {
          index = z + y * nZ + x * nYZ;
          double cV = values[index];

          double xNb = values[index + nYZ];
          if (isBorder(cV, xNb, iso)) {
            mesh.Vertices.Add(getValue(iso, cV, xNb) + x, y, z);
            xEdges[y, z] = nVs;
            nVs++;
          }

          index += nYZ;
          cV = values[index];

          if (y < nY - 1) {
            double yNb = values[index + nZ];
            if (isBorder(cV, yNb, iso)) {
              mesh.Vertices.Add(x + 1, getValue(iso, cV, yNb) + y, z);
              yEdgesUp[y, z] = nVs;
              nVs++;
            }
          }
          if (z < nZ - 1) {
            double zNb = values[index + 1];
            if (isBorder(cV, zNb, iso)) {
              mesh.Vertices.Add(x + 1, y, getValue(iso, cV, zNb) + z);
              zEdgesUp[y, z] = nVs;
              nVs++;
            }
          }
        }
      }

      // collecting the faces
      for (int y = 0; y < nY - 1; y++) {
        for (int z = 0; z < nZ - 1; z++) {
          int caseNumber = 0;
          index = z + y * nZ + x * nYZ;
          nbs[0] = values[index + nZ];
          nbs[1] = values[index + nYZ + nZ];
          nbs[2] = values[index + nYZ];
          nbs[3] = values[index];
          nbs[4] = values[index + nZ + 1];
          nbs[5] = values[index + nYZ + nZ + 1];
          nbs[6] = values[index + nYZ + 1];
          nbs[7] = values[index + 1];
          for (int i = 7; i > -1; i--) {
            if (nbs[i] > iso) {
              caseNumber++;
            }
            if (i > 0) {
              caseNumber = caseNumber << 1;
            }
          }

          edges[0] = xEdges[y + 1, z];
          edges[1] = yEdgesUp[y, z];
          edges[2] = xEdges[y, z];
          edges[3] = yEdges[y, z];

          edges[4] = xEdges[y + 1, z + 1];
          edges[5] = yEdgesUp[y, z + 1];
          edges[6] = xEdges[y, z + 1];
          edges[7] = yEdges[y, z + 1];

          edges[8] = zEdges[y + 1, z];
          edges[9] = zEdgesUp[y + 1, z];
          edges[10] = zEdges[y, z];
          edges[11] = zEdgesUp[y, z];

          int offset = caseNumber * 15;

          for (int i = offset; i < offset + 15; i += 3) {
            if (faces[i] > -1) {
              MeshFace fc = new MeshFace();

              fc.A = edges[faces[i + 0]];
              fc.B = edges[faces[i + 1]];
              fc.C = edges[faces[i + 2]];
              fc.D = fc.C;
              if (fc.IsTriangle){
                mesh.Faces.AddFace(fc);
              }
            }
          }
        }
      }
    }
    mesh.Normals.ComputeNormals();
    mesh.Compact();
    return mesh;
  }

  private void copyValuesFromAToB(int[,] array1, int[,] array2) {
    for (int i = 0; i < array1.GetLength(0); i++) {
      for (int j = 0; j < array1.GetLength(1); j++) {
        array2[i, j] = array1[i, j];
      }
    }
  }

  private double getValue(double iso, double v1, double v2) {
    if (Math.Abs(v2 - v1) < 0.0000001f) {
      return 0;
    }
    return (iso - v1) / (v2 - v1);
  }

  private bool isBorder(double v1, double v2, double iso){
    if (v1 > iso && v2 <= iso)return true;
    if (v2 > iso && v1 <= iso)return true;
    return false;
  }

  private static int[] faces = new int[] {
    -1, -1, -1, -1, -1, -1, -1, -1, -1, -1, -1,-1, -1, -1, -1,
    0, 8, 3, -1, -1, -1, -1, -1, -1, -1, -1, -1, -1,-1, -1,
    0, 1, 9, -1, -1, -1, -1, -1, -1, -1, -1, -1, -1, -1, -1,
    1,8, 3, 9, 8, 1, -1, -1, -1, -1, -1, -1, -1, -1, -1,
    1, 2, 11, -1,-1, -1, -1, -1, -1, -1, -1, -1, -1, -1, -1,
    0, 8, 3, 1, 2, 11, -1,-1, -1, -1, -1, -1, -1, -1, -1,
    9, 2, 11, 0, 2, 9, -1, -1, -1, -1,
    -1, -1, -1, -1, -1, 2, 8, 3, 2, 11, 8, 11, 9, 8, -1, -1, -1, -1,
    -1, -1, 3, 10, 2, -1, -1, -1, -1, -1, -1, -1, -1, -1, -1, -1, -1,
    0, 10, 2, 8, 10, 0, -1, -1, -1, -1, -1, -1, -1, -1, -1, 1, 9, 0, 2,
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# ---------- end frepisosurface ----------
preview = CustomPreview(Geometry=frepisosurface.A, Shader=ColourSwatch(SwatchColor=RGB(252, 108, 133)))
