# Grasshopper definition 181211_axolotl-2-0_components.gh (Grasshopper 1.0.7)

# ---- group: Primitives
axpipe = AxPipe()  # -> out, d; inputs c: list of Curve
# ---------- axpipe: Python ----------
"""Creates a pipe along a curve.
    Inputs:
        c: the axis curve
        r1: radius at the start of the curve
        r2: radius at the end of the curve
    Output:
        d: the pipe object (sdf)"""

__author__     = ['Mathias Bernhard']
__copyright__  = 'Copyright 2018 / Digital Building Technologies DBT'
__license__    = 'MIT License'
__email__      = ['<bernhard@arch.ethz.ch>']

import rhinoscriptsyntax as rs

def map_values(input_val, in_from, in_to, out_from, out_to):
    out_range = out_to - out_from
    in_range = in_to - in_from
    in_val = input_val - in_from
    val=(float(in_val)/in_range)*out_range
    out_val = out_from+val
    return out_val

class Pipe(object):
    
    def __init__(self,c=None,r1=1.0,r2=1.0):
        self.c = c
        self.r1 = r1
        self.r2 = r2
        
    def get_distance(self,x,y,z):
        p = rs.CreatePoint(x,y,z)
        param=rs.CurveClosestPoint(self.c, p)
        cp=rs.EvaluateCurve(self.c,param)
        dv = map_values(param,self.c.Domain[0],self.c.Domain[1],0,1)
        r = (1-dv)*self.r1 + dv*self.r2
        d = rs.Distance(p,cp) - r
        return d

if __name__=="__main__":
    if len(c)>0:
        if r1 is None:
            r1 = 1.0
        if r2 is None:
            r2 = 1.0
            
        if len(c)>1:
            d = [Pipe(t,r1,r2) for t in c]
        else:
            d = Pipe(c[0],r1,r2)
# ---------- end axpipe ----------
axtorus = AxTorus()  # -> out, d
# ---------- axtorus: Python ----------
"""Creates a torus.
    Inputs:
        r1: radius of the donut
        r2: radius of the pipe
    Output:
        d: the torus object (sdf)"""

__author__     = ['Mathias Bernhard']
__copyright__  = 'Copyright 2018 / Digital Building Technologies DBT'
__license__    = 'MIT License'
__email__      = ['<bernhard@arch.ethz.ch>']

import rhinoscriptsyntax as rs
import Rhino.Geometry as rg
import math

class Torus(object):
    """
    this is the torus class
    """
    def __init__(self, r1=2, r2=1):
        self.loc = rg.Vector3f(0,0,0)
        self.r1 = r1
        self.r2 = r2

    def get_distance(self,x,y,z):
        """
        distance function
        """
        dx = x-self.loc.X
        dy = y-self.loc.Y
        dz = z-self.loc.Z
        
        dxy = math.sqrt(dx**2 + dy**2)
        d2 = math.sqrt((dxy-self.r1)**2 + dz**2)
        d = d2-self.r2
        
        return d
        
if __name__=="__main__":
    if r1 is None:
        r1 = 1.5
    if r2 is None:
        r2 = 1.0
    d = Torus(r1,r2)
# ---------- end axtorus ----------
axbox = AxBox()  # -> out, d
# ---------- axbox: Python ----------
"""Creates a box with an optional edge fillet.
    Inputs:
        a: length along the x axis
        b: length along the y axis
        c: length along the z axis
        r: edge fillet radius
    Output:
        d: the box object (sdf)"""

__author__     = ['Mathias Bernhard']
__copyright__  = 'Copyright 2018 / Digital Building Technologies DBT'
__license__    = 'MIT License'
__email__      = ['<bernhard@arch.ethz.ch>']

import rhinoscriptsyntax as rs
import Rhino.Geometry as rg
import math

class RBox(object):
    """
    this is the box class
    """
    def __init__(self, a=1, b=1, c=1, r=0):
        self.loc = rg.Vector3f(0,0,0)
        #self.loc = Vector(0,0,0)
        self.a = a
        self.b = b
        self.c = c
        self.r = r
        
    def get_distance(self,x,y,z):
        """
        distance function
        """
        dx = abs(x-self.loc.X)-(self.a/2.0-self.r)
        dy = abs(y-self.loc.Y)-(self.b/2.0-self.r)
        dz = abs(z-self.loc.Z)-(self.c/2.0-self.r)
        inside = max([dx,dy,dz])-self.r
        dx = max(dx,0)
        dy = max(dy,0)
        dz = max(dz,0)
        if inside+self.r>0:
            #rounded corner case
            return math.sqrt(dx**2 + dy**2 + dz**2) - self.r 
        else:
            return inside
        
    def get_bounds(self):
        return (self.loc.X-self.a/2.0, self.loc.Y-self.b/2.0, self.loc.Z-self.c/2.0,
                self.loc.X+self.a/2.0, self.loc.Y+self.b/2.0, self.loc.Z+self.c/2.0)
                
if __name__=="__main__":
    if a is None:
        a = 2
    if b is None:
        b = 3
    if c is None:
        c = 4
    if r is None:
        r = 0
    d = RBox(a,b,c,r)
# ---------- end axbox ----------
axcylinder = AxCylinder()  # -> out, d
# ---------- axcylinder: Python ----------
"""Creates a cylinder.
    Inputs:
        r: radius of the cylinder
        h: height of the cylinder
    Output:
        d: the cylinder object (sdf)"""

__author__     = ['Mathias Bernhard']
__copyright__  = 'Copyright 2018 / Digital Building Technologies DBT'
__license__    = 'MIT License'
__email__      = ['<bernhard@arch.ethz.ch>']

import rhinoscriptsyntax as rs
import Rhino.Geometry as rg
import math

class Cylinder(object):
    """
    this is the cylinder class
    """
    def __init__(self, r=1, h=1):
        self.loc = rg.Vector3f(0,0,0)
        self.r = r
        self.h = h

    def get_distance(self,x,y,z):
        """
        distance function
        """
        dx = x-self.loc.X
        dy = y-self.loc.Y
        dz = abs(z-self.loc.Z)
        
        # 2d circle distance
        dxy = math.sqrt(dx**2 + dy**2) - self.r
        # cut with cap plances
        d = max(dxy, dz-self.h/2.0)
        return d
        
if __name__=="__main__":
    if r is None:
        r = 1.0
    if h is None:
        h = 2.0
    d = Cylinder(r,h)
# ---------- end axcylinder ----------
axplane = AxPlane()  # -> out, d; inputs n: list of Vector3d
# ---------- axplane: Python ----------
"""Creates a series of planes.
    Inputs:
        n: list of normal vectors
        o: offset distance from the origin
    Output:
        d: the plane object (sdf)"""

__author__     = ['Mathias Bernhard']
__copyright__  = 'Copyright 2018 / Digital Building Technologies DBT'
__license__    = 'MIT License'
__email__      = ['<bernhard@arch.ethz.ch>']

import rhinoscriptsyntax as rs
import Rhino.Geometry as rg

class Plane(object):
    """
    this is the plane class
    """
    def __init__(self, nx=0, ny=0, nz=1, dst=0):
        self.nrm = rg.Vector3f(nx,ny,nz)
        self.nrm.Unitize()
        self.d = dst

    def get_distance(self,x,y,z):
        dp = rs.VectorDotProduct(self.nrm, rg.Vector3d(x,y,z))
        return - (dp+self.d)

if __name__=="__main__":
    if o is None:
        o = 0.0
    if len(n)>1:
        d = [Plane(t.X,t.Y,t.Z,o) for t in n]
    elif len(n)==1:
        d = Plane(n[0].X,n[0].Y,n[0].Z,o)
    else:
        n = rg.Vector3f(0,0,1)
        d = Plane(n.X,n.Y,n.Z,o)
# ---------- end axplane ----------
axsphere = AxSphere()  # -> out, d
# ---------- axsphere: Python ----------
"""Creates a sphere.
    Inputs:
        r: sphere radius
    Output:
        d: the sphere object (sdf)"""

__author__     = ['Mathias Bernhard']
__copyright__  = 'Copyright 2018 / Digital Building Technologies DBT'
__license__    = 'MIT License'
__email__      = ['<bernhard@arch.ethz.ch>']

import rhinoscriptsyntax as rs
import Rhino.Geometry as rg
import math

class Sphere(object):
    """
    this is the box class
    """
    def __init__(self, r=0):
        self.loc = rg.Vector3f(0,0,0)
        self.r = r
        
    def get_distance(self,x,y,z):
        """
        distance function
        """
        # long version
        d = math.sqrt((x-self.loc.X)**2 + (y-self.loc.Y)**2 + (z-self.loc.Z)**2) - self.r
        
        return d
    
    def get_bounds(self):
        return (self.loc.X-self.r, self.loc.Y-self.r, self.loc.Z-self.r,
                self.loc.X+self.r, self.loc.Y+self.r, self.loc.Z+self.r)
                
if __name__=="__main__":
    if r is None:
        r = 1
    d = Sphere(r)
# ---------- end axsphere ----------

# ---- group: Combinations
axunion = AxUnion()  # -> out, d; inputs a: list
# ---------- axunion: Python ----------
"""Creates a Boolean union.
    Inputs:
        a: list of / single sdf object(s)
        b: second sdf object
    Output:
        d: the union object (sdf)"""

__author__     = ['Mathias Bernhard']
__copyright__  = 'Copyright 2018 / Digital Building Technologies DBT'
__license__    = 'MIT License'
__email__      = ['<bernhard@arch.ethz.ch>']

import rhinoscriptsyntax as rs

class Union(object):
    """
    boolean union of two or more objects
    """
    def __init__(self, obja=None, objb=None):
        if type(obja)==type([]):
            self.objs = obja
        else:
            self.objs = [obja,objb]
        
    def get_distance(self,x,y,z):
        ds = [o.get_distance(x,y,z) for o in self.objs]
        return min(ds)

if __name__=="__main__":
    if a is not None:
        d = Union(a,b)
# ---------- end axunion ----------
axsubtraction = AxSubtraction(a=axtorus.d, b=axbox.d)  # -> out, d
# ---------- axsubtraction: Python ----------
"""Creates a Boolean subtraction a-b.
    Inputs:
        a: sdf object to subtract from
        b: sdf object to subtract
    Output:
        d: the subtraction/difference object (sdf)"""

__author__     = ['Mathias Bernhard']
__copyright__  = 'Copyright 2018 / Digital Building Technologies DBT'
__license__    = 'MIT License'
__email__      = ['<bernhard@arch.ethz.ch>']

import rhinoscriptsyntax as rs

class Subtraction(object):
    """
    boolean subtraction of a minus b
    """
    def __init__(self, obja, objb):
        self.a = obja
        self.b = objb
        
    def get_distance(self,x,y,z):
        da = self.a.get_distance(x,y,z)
        db = self.b.get_distance(x,y,z)
        return max(da,-db)

if __name__=="__main__":
    if a is not None and b is not None:
        d = Subtraction(a,b)
        print d.get_distance(3,4,5)
# ---------- end axsubtraction ----------
axintersection = AxIntersection()  # -> out, d; inputs a: list
# ---------- axintersection: Python ----------
"""Creates a Boolean intersection.
    Inputs:
        a: list of / single sdf object(s)
        b: second sdf object
    Output:
        d: the intersection object (sdf)"""

__author__     = ['Mathias Bernhard']
__copyright__  = 'Copyright 2018 / Digital Building Technologies DBT'
__license__    = 'MIT License'
__email__      = ['<bernhard@arch.ethz.ch>']

import rhinoscriptsyntax as rs

class Intersection(object):
    """
    boolean intersection of two or more objects
    """
    def __init__(self, obja=None, objb=None):
        if type(obja)==type([]):
            self.objs = obja
        else:
            self.objs = [obja,objb]
        
    def get_distance(self,x,y,z):
        ds = [o.get_distance(x,y,z) for o in self.objs]
        return max(ds)

if __name__=="__main__":
    if a is not None:
        d = Intersection(a,b)
# ---------- end axintersection ----------
axblend = AxBlend()  # -> out, d
# ---------- axblend: Python ----------
"""Creates a smooth blend union.
    Inputs:
        a: first sdf object
        b: second sdf object
        f: smoothing factor (default 2.0)
    Output:
        d: the blend object (sdf)"""

__author__     = ['Mathias Bernhard']
__copyright__  = 'Copyright 2018 / Digital Building Technologies DBT'
__license__    = 'MIT License'
__email__      = ['<bernhard@arch.ethz.ch>']

import rhinoscriptsyntax as rs

class Blend(object):
    """
    smooth blend between a and b
    """
    def __init__(self, obja, objb, r=2.0):
        self.a = obja
        self.b = objb
        self.r = r
        
    def get_distance(self,x,y,z):
        da = self.a.get_distance(x,y,z)
        db = self.b.get_distance(x,y,z)
        e = max(self.r - abs(da-db), 0)
        return min(da,db) - e*e*0.25/self.r

if __name__=="__main__":
    if a is not None and b is not None:
        if f is None:
            f = 2.0
        d = Blend(a,b,f)
# ---------- end axblend ----------
axmorph = AxMorph()  # -> out, d
# ---------- axmorph: Python ----------
"""Morphs one object into another object.
    Inputs:
        a: first object (sdf)
        b: second object (sdf)
        f: morphing factor, 0: a, 1: b, d=(1-f)*a+f*b
    Output:
        d: the intermediate object (sdf)"""

__author__     = ['Mathias Bernhard']
__copyright__  = 'Copyright 2018 / Digital Building Technologies DBT'
__license__    = 'MIT License'
__email__      = ['<bernhard@arch.ethz.ch>']

import rhinoscriptsyntax as rs

class Morph(object):
    def __init__(self,a=None,b=None,f=0.5):
        self.a = a
        self.b = b
        self.f = f

    def get_distance(self,x,y,z):
        da = self.a.get_distance(x,y,z)
        db = self.b.get_distance(x,y,z)
        return (1-self.f)*da + self.f*db

if __name__=="__main__":
    if a is not None and b is not None:
        if f is None:
            f = 0.5
        d = Morph(a,b,f)
# ---------- end axmorph ----------

# ---- group: Modifications
axtransform = AxTransform()  # -> out, d
# ---------- axtransform: Python ----------
"""Applies a matrix transformation to an object.
    Inputs:
        x: the sdf object to be transformed
        m: the 4x4 transformation matrix (e.g. translation, rotation, shear...)
    Output:
        d: the transformed object (sdf)"""

__author__     = ['Mathias Bernhard']
__copyright__  = 'Copyright 2018 / Digital Building Technologies DBT'
__license__    = 'MIT License'
__email__      = ['<bernhard@arch.ethz.ch>']

import rhinoscriptsyntax as rs
import Rhino.Geometry as rg

class Transform(object):
    def __init__(self,o=None,m=None):
        self.o = o
        self.m = m
        success, self.orig = self.m.TryGetInverse()
        
    def get_distance(self,x,y,z):
        p = rg.Point3f(x,y,z)
        p.Transform(self.orig)
        return self.o.get_distance(p.X,p.Y,p.Z)

if __name__=="__main__":
    if x is not None:
        if m is None:
            m = rg.Transform.Identity
        d = Transform(x,m)
        print d.get_distance(6,7,0)
# ---------- end axtransform ----------
axtwist = AxTwist()  # -> out, d
# ---------- axtwist: Python ----------
"""Creates a twist object (works only for those who have a get_bounds method).
    Inputs:
        x: the solid sdf object to be twisted
        a: the twist angle
    Output:
        d: the twist object (sdf)"""

__author__     = ['Mathias Bernhard']
__copyright__  = 'Copyright 2018 / Digital Building Technologies DBT'
__license__    = 'MIT License'
__email__      = ['<bernhard@arch.ethz.ch>']

import rhinoscriptsyntax as rs
import math

class Twist(object):
    def __init__(self,obj=None, ang=0.0):
        self.o = obj
        self.angle = float(ang)

    def get_distance(self,x,y,z):
        bnds = self.o.get_bounds()
        t = (z-bnds[2])/(bnds[5]-bnds[2]) - 0.5
        theta = t*self.angle
        nx = (x*math.cos(theta) - y*math.sin(theta))
        ny = (x*math.sin(theta) + y*math.cos(theta))
        return self.o.get_distance(nx,ny,z)

if __name__=="__main__":
    if x is not None:
        if a is None:
            a = 1.0
        d = Twist(x,a)
# ---------- end axtwist ----------
axgradient = AxGradient()  # -> out, d
# ---------- axgradient: Python ----------
"""Creates a gradient by adding a fraction of object b to object a.
    Inputs:
        a: the base sdf object (modified)
        b: the object to be added (modifier)
        f: intensity factor (d = a + f * b), default: 0.01
    Output:
        d: the modified object (sdf)"""

__author__     = ['Mathias Bernhard']
__copyright__  = 'Copyright 2018 / Digital Building Technologies DBT'
__license__    = 'MIT License'
__email__      = ['<bernhard@arch.ethz.ch>']

import rhinoscriptsyntax as rs

class Gradient(object):
    """
    modifies obj a with a fraction (f) of obj b
    """
    def __init__(self, obja, objb, f=0.1):
        self.a = obja
        self.b = objb
        self.f = f
        
    def get_distance(self,x,y,z):
        da = self.a.get_distance(x,y,z)
        db = self.b.get_distance(x,y,z)
        return da+self.f*db

if __name__=="__main__":
    if a is not None and b is not None:
        if f is None:
            f = 0.01
        d = Gradient(a,b,f)
# ---------- end axgradient ----------
axshell = AxShell()  # -> out, d
# ---------- axshell: Python ----------
"""Creates a shell from a solid.
    Inputs:
        x: the solid sdf object
        t: thickness of the shell
        s: side factor (1: inside, 0.5: half/half, 0: outside)
    Output:
        d: the shell object (sdf)"""

__author__     = ['Mathias Bernhard']
__copyright__  = 'Copyright 2018 / Digital Building Technologies DBT'
__license__    = 'MIT License'
__email__      = ['<bernhard@arch.ethz.ch>']

import rhinoscriptsyntax as rs

class Shell(object):
    """
    creates a shell of thickness d
    side factor s:
        1.0 > inside
        0.5 > half half
        0.0 > outside
    """

    def __init__(self, obj, d=1.0, s=0.0):
        self.o = obj
        self.d = d
        self.s = s

    def get_distance(self,x,y,z):
        do = self.o.get_distance(x,y,z)
        return abs(do + (self.s-0.5)*self.d)-self.d/2.0

if __name__=="__main__":
    if x is not None:
        if t is None:
            t = 1.0
        if s is None:
            s = 0.5
        d = Shell(x,t,s)
# ---------- end axshell ----------

# ---- group: Meshing
axoctree = AxOctree(x=axsubtraction.d)  # -> out, t; inputs p: Point3d, n: Int32
# ---------- axoctree: Python ----------
"""Creates a sparse voxel octree (SVO) subdivision.
    Inputs:
        x: the sdf object used for distance calculation
        p: the center point of the root node (default: 0,0,0)
        d: the edge length of the root node (default: 6.0)
        n: the maximum number of subdivisions (default: 4)
    Output:
        t: the octree object, t.leafs is a list of leaf nodes (for MC meshing)"""

__author__     = ['Mathias Bernhard']
__copyright__  = 'Copyright 2018 / Digital Building Technologies DBT'
__license__    = 'MIT License'
__email__      = ['<bernhard@arch.ethz.ch>']

import rhinoscriptsyntax as rs
import Rhino.Geometry as rg
import math

class OcTree(object):
    """
    octree class for adaptive subdivision
    """
    def __init__(self, pt, ws):
        self.worldsize = float(ws)
        self.maxlevels = 3
        self.sqrt2 = math.sqrt(2.0)
        self.sqrt3 = math.sqrt(3.0)
        self.pos = pt
        self.rootnode = OctNode(pt.X,pt.Y,pt.Z, ws, 0)
        self.distobj = None
        self.leafs = []

    def set_level(self, n):
        self.maxlevels = int(n)

    def divide(self, node):
        if node.level < self.maxlevels:
            d = self.distobj.get_distance(node.pos.X, node.pos.Y, node.pos.Z)
            node.distance = d
            if abs(d) < self.sqrt3 * node.edge/2:
                node.divide_node()
                for b in node.branches:
                    self.divide(b)
        else:
            self.leafs.append(node)

class OctNode(object):
    """
    node of octree that is either leaf node
    or has 8 child nodes as branches
    """
    def __init__(self, x,y,z, s, l):
        self.pos = rg.Vector3f(x,y,z)
        self.edge = s
        self.level = l
        self.branches = None
        self.distance = 0.0

    def divide_node(self):
        self.branches = []
        qs = self.edge/4.0
        nl = self.level + 1
        self.branches.append(OctNode(self.pos.X-qs, self.pos.Y-qs, self.pos.Z-qs, qs*2, nl))
        self.branches.append(OctNode(self.pos.X+qs, self.pos.Y-qs, self.pos.Z-qs, qs*2, nl))
        self.branches.append(OctNode(self.pos.X-qs, self.pos.Y+qs, self.pos.Z-qs, qs*2, nl))
        self.branches.append(OctNode(self.pos.X+qs, self.pos.Y+qs, self.pos.Z-qs, qs*2, nl))
        self.branches.append(OctNode(self.pos.X-qs, self.pos.Y-qs, self.pos.Z+qs, qs*2, nl))
        self.branches.append(OctNode(self.pos.X+qs, self.pos.Y-qs, self.pos.Z+qs, qs*2, nl))
        self.branches.append(OctNode(self.pos.X-qs, self.pos.Y+qs, self.pos.Z+qs, qs*2, nl))
        self.branches.append(OctNode(self.pos.X+qs, self.pos.Y+qs, self.pos.Z+qs, qs*2, nl))

if __name__=="__main__":
    if x is not None:
        if p is None:
            p = rg.Point3f(0,0,0)
        if d is None:
            d = 6.0
        if n is None:
            n = 4
        t = OcTree(p,d)
        t.distobj = x
        t.set_level(n)
        t.divide(t.rootnode)
# ---------- end axoctree ----------
axmcube = AxMCube(t=axoctree.t)  # -> out, m, p
# ---------- axmcube: Python ----------
"""Creates a marching cubes isosurface.
    Inputs:
        t: the subdivided octree
    Output:
        m: the isosurface mesh
        p: the leaf node center points (for debugging)"""

__author__     = ['Mathias Bernhard']
__copyright__  = 'Copyright 2018 / Digital Building Technologies DBT'
__license__    = 'MIT License'
__email__      = ['<bernhard@arch.ethz.ch>']

import rhinoscriptsyntax as rs
import Rhino.Geometry as rg

# From BorisTheBrave
# blog: https://www.boristhebrave.com/2018/04/15/marching-cubes-3d-tutorial/
# repo: https://github.com/BorisTheBrave/mc-dc/

# My convention for vertices is:
VERTICES = [
    (0, 0, 0),
    (1, 0, 0),
    (1, 1, 0),
    (0, 1, 0),
    (0, 0, 1),
    (1, 0, 1),
    (1, 1, 1),
    (0, 1, 1),
]


# My convention for the edges
EDGES = [
    (0, 1),
    (1, 2),
    (2, 3),
    (3, 0),
    (4, 5),
    (5, 6),
    (6, 7),
    (7, 4),
    (0, 4),
    (1, 5),
    (2, 6),
    (3, 7),
]

# Table driven approach to the 256 combinations. Pro-tip, don't write this by hand, copy mine!
# See marching_cubes_gen.py for how I generated these.
# Each index is the bitwise representation of what is solid.
# Each value is a list of triples indicating what edges are used for that triangle
# (Recall each edge of the cell may become a vertex in the output boundary)
cases = [[],
 [[8, 0, 3]],
 [[1, 0, 9]],
 [[8, 1, 3], [8, 9, 1]],
 [[10, 2, 1]],
 [[8, 0, 3], [1, 10, 2]],
 [[9, 2, 0], [9, 10, 2]],
 [[3, 8, 2], [2, 8, 10], [10, 8, 9]],
 [[3, 2, 11]],
 [[0, 2, 8], [2, 11, 8]],
 [[1, 0, 9], [2, 11, 3]],
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 []]

ADAPTIVE = True
def adapt(v0, v1):
    """v0 and v1 are numbers of opposite sign. This returns how far you need to interpolate from v0 to v1 to get to 0."""
    assert (v1 > 0) != (v0 > 0), "v0 and v1 do not have opposite sign"
    if ADAPTIVE:
        return (0 - v0) / (v1 - v0)
    else:
        return 0.5

def marching_cubes_3d_single_cell(f, x, y, z, el):
    # Evaluate f on each vertex of the cube
    # el (edge length) addition by mathias bernhard
    f_eval = [None] * 8
    for v in range(8):
        v_pos = VERTICES[v]
        f_eval[v] = f(x + (v_pos[0]-0.5)*el, y + (v_pos[1]-0.5)*el, z + (v_pos[2]-0.5)*el)
    # Determine which case we are
    case = sum(2**v for v in range(8) if f_eval[v] > 0)
    # Ok, what faces do we need (in terms of edges)
    faces = cases[case]

    def edge_to_boundary_vertex(edge):
        """Returns the vertex in the middle of the specified edge"""
        # Find the two vertices specified by this edge, and interpolate between
        # them according to adapt, as in the 2d case
        v0, v1 = EDGES[edge]
        f0 = f_eval[v0]
        f1 = f_eval[v1]
        t0 = (1 - adapt(f0, f1))
        t1 = (1 - t0)
        vert_pos0 = VERTICES[v0]
        vert_pos1 = VERTICES[v1]
        return rg.Vector3f(x + ((vert_pos0[0]) * t0 + (vert_pos1[0]) * t1 - 0.5) * el,
                    y + ((vert_pos0[1]) * t0 + (vert_pos1[1]) * t1 - 0.5) * el,
                    z + ((vert_pos0[2]) * t0 + (vert_pos1[2]) * t1 - 0.5) * el)

    if len(faces)>0:
        m = rg.Mesh()
        for face in faces:
            # For each face, find the vertices of that face, and output it.
            # We make no effort to re-use vertices between multiple faces,
            # A fancier implementation might do so.
            edges = face
            verts = list(map(edge_to_boundary_vertex, edges))
            nvi = len(m.Vertices)
            for n in verts:
                m.Vertices.Add(n.X,n.Y,n.Z)
            f = rg.MeshFace(nvi+0,nvi+1,nvi+2)
            m.Faces.AddFace(f)
        return m
    
if __name__=="__main__":
    if t is not None:
        p = [l.pos for l in t.leafs]
        tm = rg.Mesh()
        for l in t.leafs:
            cm = marching_cubes_3d_single_cell(t.distobj.get_distance,
                                               l.pos.X, l.pos.Y, l.pos.Z, l.edge)
            if cm is not None:
                tm.Append(cm)
        tm.Vertices.CombineIdentical(True,True)
        
        # validate mesh by removing faces with two identical vertex indices
        m = rg.Mesh()
        m.Vertices.AddVertices(tm.Vertices)
        for i in range(len(tm.Faces)):
            f = tm.Faces[i]
            if len(set(f))<3:
                print i,len(set(f))
            else:
                m.Faces.AddFace(f)
        
        m.Normals.ComputeNormals()
        m.Compact()
# ---------- end axmcube ----------

# ---- group: Lattices
axtpms = AxTPMS()  # -> out, d; inputs i: Int32
# ---------- axtpms: Python ----------
__author__ = "user"
__version__ = "2018.12.11"

import math

class TPMS(object):
    def __init__(self, w=10.0):
        self.wl = w
        self.fact = self.wl/(math.pi)
        
    def get_distance(self,x,y,z):
        px = x/self.fact
        py = y/self.fact
        pz = z/self.fact
        return self.get_value(px,py,pz)
    
    def get_value(self,x,y,z):
        return 0

class Gyroid(TPMS):
    def get_value(self,px,py,pz):
        return math.sin(px)*math.cos(py) + math.sin(py)*math.cos(pz) + math.sin(pz)*math.cos(px)

class SchwartzP(TPMS):
    def get_value(self,px,py,pz):
        return math.cos(px)+math.cos(py)+math.cos(pz)

class Diamond(TPMS):
    def get_value(self,px,py,pz):
        return (
            math.sin(px) * math.sin(py) * math.sin(pz) + 
            math.sin(px) * math.cos(py) * math.cos(pz) + 
            math.cos(px) * math.sin(py) * math.cos(pz) +
            math.cos(px) * math.cos(py) * math.sin(pz))

class FischerKoch(TPMS):
    def get_value(self,px,py,pz):
        return (
            math.cos(2*px) * math.sin(py) * math.cos(pz) +
            math.cos(2*py) * math.sin(pz) * math.cos(px) +
            math.cos(2*pz) * math.sin(px) * math.cos(py))

if __name__=="__main__":
    if i is None:
        i = 0
    if w is None:
        w = 10.0
    tpms = [Gyroid(w),SchwartzP(w),Diamond(w),FischerKoch(w)]
    d = tpms[i]
# ---------- end axtpms ----------

# ----
custom_preview = CustomPreview(
    Geometry=axmcube.m,
    Material={diffuse=RGB(221, 160, 221), emission=RGB(66, 48, 66), shine=0.5, specular=RGB(255, 255, 255), transparency=0})
