# Grasshopper definition 00_basics.gh (Grasshopper 0.9.76)
# plug-ins: Python Interpreter, Millipede

# ---- group: generation of the voxel field
number_slider = Slider(1.5, range=0..10)
box = DomainBox(Base=PlaneXY(0, 0, 0), X="0 to 50", Y="0 to 40", Z="0 to 30")
frepvoxelgrid = FRepVoxelGrid(box=box, dim=number_slider)  # -> wbox, nx, ny, nz, pts

# ---- group: construct csg tree
pt = Point(<point referenced from the Rhino model>)
pt_2 = Point(<point referenced from the Rhino model>)
frepsphere = FRepSphere(center=pt_2, radius=Slider(10, range=0..20), pts=frepvoxelgrid.pts)  # -> out, a; inputs center: Point3d, pts: list of Point3d
# ---------- frepsphere: Python ----------
#!/usr/bin/env python2
# -*- coding: utf-8 -*-

__author__     = ['Mathias Bernhard']
__copyright__  = 'Copyright 2018 / Digital Building Technologies DBT / ETH Zurich'
__license__    = 'MIT License'
__email__      = '<bernhard@arch.ethz.ch>'

import rhinoscriptsyntax as rs

a = [rs.Distance(center,p)-radius for p in pts]
# ---------- end frepsphere ----------
freptorus = FRepTorus(center=pt, radius_a=Slider(20, range=0..20), radius_b=Slider(3, range=0..20), pts=frepvoxelgrid.pts)  # -> out, a; inputs center: Point3d, pts: list of Point3d
# ---------- freptorus: Python ----------
#!/usr/bin/env python2
# -*- coding: utf-8 -*-

"""
Creates a Torus
Inputs:
    center: The center point of the torus
    radius_a: Radius from center to axis
    radius_b: Radius of pipe around axis
    pts: List of points to query
Output:
    a: Distance values for all points in pts
"""

__author__     = ['Mathias Bernhard']
__copyright__  = 'Copyright 2018 / Digital Building Technologies DBT / ETH Zurich'
__license__    = 'MIT License'
__email__      = '<bernhard@arch.ethz.ch>'

import rhinoscriptsyntax as rs
import math

def get_dist(p):
    lxy = math.sqrt(math.pow(center[0]-p[0],2) + math.pow(center[1]-p[1],2))
    l2  = math.sqrt(math.pow(lxy-radius_a,2) + math.pow(center[2]-p[2],2))
    return l2-radius_b

a = [get_dist(p) for p in pts]
# ---------- end freptorus ----------
frepsubtraction = FRepSubtraction(A=frepsphere.a, B=freptorus.a)  # -> out, a; inputs A: list, B: list
# ---------- frepsubtraction: Python ----------
#!/usr/bin/env python2
# -*- coding: utf-8 -*-

__author__     = ['Mathias Bernhard']
__copyright__  = 'Copyright 2018 / Digital Building Technologies DBT / ETH Zurich'
__license__    = 'MIT License'
__email__      = '<bernhard@arch.ethz.ch>'

a = [max(t[0],-t[1]) for t in zip(A,B)]
# ---------- end frepsubtraction ----------

# ---- group: volumetric display of distance field
freplistrange = FRepListrange(a=frepsubtraction.a)  # -> out, v_min, v_max, v; inputs a: list
# ---------- freplistrange: Python ----------
#!/usr/bin/env python2
# -*- coding: utf-8 -*-

__author__     = ['Mathias Bernhard']
__copyright__  = 'Copyright 2018 / Digital Building Technologies DBT / ETH Zurich'
__license__    = 'MIT License'
__email__      = '<bernhard@arch.ethz.ch>'

v_min = min(a)
v_max = max(a)
v = a
# ---------- end freplistrange ----------
gradient = Gradient(
    LowerLimit=freplistrange.v_min,
    UpperLimit=freplistrange.v_max,
    Parameter=freplistrange.v,
    stops=[0: RGB(243, 57, 0), 0.1: RGB(236, 27, 60), 0.2: RGB(210, 0, 118), 0.3: RGB(103, 0, 120), 0.4: RGB(39, 72, 161), 0.5: RGB(1, 192, 229), 0.6: RGB(18, 178, 90), 0.7: RGB(79, 186, 8), 0.8: RGB(220, 237, 32), 0.9: RGB(247, 159, 20), 1: RGB(243, 57, 0)])
division = Division(A=number_slider, B="3.0")
dots = DotDisplay(Point=frepvoxelgrid.pts, Colour=gradient, Size=division)

# ---- group: isosurface mesh generation
iso_surface = IsoSurface(
    Box=frepvoxelgrid.wbox,
    Values=frepsubtraction.a,
    XResolution=frepvoxelgrid.nx,
    YResolution=frepvoxelgrid.ny,
    ZResolution=frepvoxelgrid.nz,
    IsoValue=0,
    MergeVertices=True)
preview = CustomPreview(Geometry=iso_surface, Shader=ColourSwatch(SwatchColor=RGB(252, 108, 133)))

# ==== cluster FRepVoxelGrid: Creates the initial grid of voxels. Outputs number of cells in X, Y and Z and a list of query points.
box = ClusterInput()
box_corners = BoxCorners(Box=box)  # -> CornerA, CornerB, CornerC, CornerD, CornerE, CornerF, CornerG, CornerH
bbox = BoundingBox(
    Content=[box_corners.CornerA, box_corners.CornerB, box_corners.CornerC, box_corners.CornerD, box_corners.CornerE, box_corners.CornerF, box_corners.CornerG, box_corners.CornerH],
    Plane=PlaneXY(0, 0, 0),
    UnionBox=True)  # -> wBox, B
dim = ClusterInput()
c_script = CSharpScript(Box=bbox.wBox, dim=dim)  # -> out, nx, ny, nz, pts; inputs Box: Box, dim: Double
# ---------- c_script: C# ----------
    double dx = Box.X[1] - Box.X[0];
    double dy = Box.Y[1] - Box.Y[0];
    double dz = Box.Z[1] - Box.Z[0];

    int nxt = (int) Math.Round(dx / dim);
    int nyt = (int) Math.Round(dy / dim);
    int nzt = (int) Math.Round(dz / dim);
    
    double dimx = dx / nxt;
    double dimy = dy / nyt;
    double dimz = dz / nzt;

    nx = nxt;
    ny = nyt;
    nz = nzt;

    Point3d[] res = new Point3d[nxt * nyt * nzt];
    int i = 0;
    for (int z = 0; z < nzt; z++) {
      for (int y = 0; y < nyt; y++) {
        for (int x = 0; x < nxt; x++) {
          double px = dimx / 2 + Box.Center[0] - dx / 2 + x * dimx;
          double py = dimy / 2 + Box.Center[1] - dy / 2 + y * dimy;
          double pz = dimz / 2 + Box.Center[2] - dz / 2 + z * dimz;
          res[i] = new Point3d(px, py, pz);
          i++;
        }
      }
    }
    pts = res;
# ---------- c_script: C# additional code ----------
  /*
  #!/usr/bin/env python2
  # -*- coding: utf-8 -*-

  __author__     = ['Mathias Bernhard']
  __copyright__  = 'Copyright 2018 / Digital Building Technologies DBT / ETH Zurich'
  __license__    = 'MIT License'
  __email__      = '<bernhard@arch.ethz.ch>'

  import rhinoscriptsyntax as rs

  dx = Box.X[1]-Box.X[0]
  dy = Box.Y[1]-Box.Y[0]
  dz = Box.Z[1]-Box.Z[0]

  nx = int(dx/dim)+1
  ny = int(dy/dim)+1
  nz = int(dz/dim)+1

  pts = []
  for z in range(nz):
  for y in range(ny):
  for x in range(nx):
  px = dim/2 + Box.Center[0]-dx/2 + x*dim
  py = dim/2 + Box.Center[1]-dy/2 + y*dim
  pz = dim/2 + Box.Center[2]-dz/2 + z*dim
  pts.append(rs.AddPoint(px,py,pz))

  */

  /// <summary>
  /// This method will be called once every solution, before any calls to RunScript.
  /// </summary>
  public override void BeforeRunScript()
  { }
  /// <summary>
  /// This method will be called once every solution, after any calls to RunScript.
  /// </summary>
  public override void AfterRunScript()
  { }
# ---------- end c_script ----------
wbox = ClusterOutput(bbox.wBox)
nx = ClusterOutput(c_script.nx)
ny = ClusterOutput(c_script.ny)
nz = ClusterOutput(c_script.nz)
pts = ClusterOutput(c_script.pts)
