# Grasshopper definition 01_landscape.gh (Grasshopper 0.9.76)
# plug-ins: Python Interpreter, Millipede

# ---- group: generate voxel space from heightmap
path = FilePath("path\to\heightmap\terrain_small.png")
freplandscape = FRepLandscape(filepath=path)  # -> out, nx, ny, nz, pts, a
# ---------- freplandscape: Python ----------
#!/usr/bin/env python2
# -*- coding: utf-8 -*-

"""
Creates a VoxelSpace from an image (heightmap) located at <filepath>.
"""

__author__     = ['Mathias Bernhard']
__copyright__  = 'Copyright 2018 / Digital Building Technologies DBT / ETH Zurich'
__license__    = 'MIT License'
__email__      = '<bernhard@arch.ethz.ch>'

import System
import rhinoscriptsyntax as rs

path = filepath

bitmap = System.Drawing.Bitmap.FromFile(path)
nx = bitmap.Width
ny = bitmap.Height
nz = 20

a = []
for z in xrange(nz):
    for y in xrange(ny):
        for x in xrange(nx):
            color = System.Drawing.Bitmap.GetPixel(bitmap, x,ny-1-y)
            val = 5 * (z/20.0 - (0.1+color.R/255.0*0.8))
            # uncomment the following 2 lines to create a solid
            if z==0 or z==nz-1 or y==0 or y==ny-1 or x==0 or x==nx-1:
                val = 1000
            a.append(val)
            
pts = [rs.AddPoint(x,y,z) for z in range(nz) for y in range(ny) for x in range(nx)]
# ---------- end freplandscape ----------
box = DomainBox(Base=PlaneXY(0, 0, 0), X="0 to 80", Y="0 to 60", Z="0 to 20")

# ---- group: dig tunnel
number_slider = Slider(3, range=0..10)
crv = Curve(<curve referenced from the Rhino model>)
freppipe = FRepPipe(axis=crv, start_radius=number_slider, end_radius=number_slider, pts=freplandscape.pts)  # -> out, a; inputs axis: Curve, pts: list of Point3d
# ---------- freppipe: Python ----------
#!/usr/bin/env python2
# -*- coding: utf-8 -*-

__author__     = ['Mathias Bernhard']
__copyright__  = 'Copyright 2018 / Digital Building Technologies DBT / ETH Zurich'
__license__    = 'MIT License'
__email__      = '<bernhard@arch.ethz.ch>'

import rhinoscriptsyntax as rs
import math

def map_values(input_val, in_from, in_to, out_from, out_to):
    out_range = out_to - out_from
    in_range = in_to - in_from
    in_val = input_val - in_from
    val=(float(in_val)/in_range)*out_range
    out_val = out_from+val
    return out_val

def get_dist(p):
    param=rs.CurveClosestPoint(axis, p)
    cp=rs.EvaluateCurve(axis,param)
    dv = map_values(param,axis.Domain[0],axis.Domain[1],0,1)
    r = (1-dv)*start_radius + dv*end_radius
    d = rs.Distance(p,cp) - r
    return d
        
if __name__ == '__main__':
    a = [get_dist(p) for p in pts]
# ---------- end freppipe ----------
frepsubtraction = FRepSubtraction(A=freplandscape.a, B=freppipe.a)  # -> out, a; inputs A: list, B: list
# ---------- frepsubtraction: Python ----------
#!/usr/bin/env python2
# -*- coding: utf-8 -*-

__author__     = ['Mathias Bernhard']
__copyright__  = 'Copyright 2018 / Digital Building Technologies DBT / ETH Zurich'
__license__    = 'MIT License'
__email__      = '<bernhard@arch.ethz.ch>'

a = [max(t[0],-t[1]) for t in zip(A,B)]
# ---------- end frepsubtraction ----------

# ---- group: create tunnel walls and bridges
pt = Point(<point referenced from the Rhino model>)
frepbox = FRepBox(center=pt, L="80", B="80", H="10", fillet_radius=0, pts=freplandscape.pts)  # -> out, a; inputs center: Point3d, pts: list of Point3d
# ---------- frepbox: Python ----------
#!/usr/bin/env python2
# -*- coding: utf-8 -*-

__author__     = ['Mathias Bernhard']
__copyright__  = 'Copyright 2018 / Digital Building Technologies DBT / ETH Zurich'
__license__    = 'MIT License'
__email__      = '<bernhard@arch.ethz.ch>'

import rhinoscriptsyntax as rs
import math

def get_dist(p):
    dx = abs(p[0]-center[0]) - (L/2-fillet_radius)
    dy = abs(p[1]-center[1]) - (B/2-fillet_radius)
    dz = abs(p[2]-center[2]) - (H/2-fillet_radius)
    inside = max(dx,max(dy,dz)) - fillet_radius
    dx = max(dx,0)
    dy = max(dy,0)
    dz = max(dz,0)
    corner = math.pow(dx*dx + dy*dy + dz*dz,0.5) - fillet_radius
    if inside+fillet_radius>0:
        return corner
    else:
        return inside
    
if __name__ == '__main__':
    a = [get_dist(p) for p in pts]
# ---------- end frepbox ----------
frepshell = FRepShell(vals=freppipe.a, thickness=Slider(1, range=0..2), side=0)  # -> out, a; inputs vals: list
# ---------- frepshell: Python ----------
#!/usr/bin/env python2
# -*- coding: utf-8 -*-
"""
Creates a shell from the solid object. Thickness and position (inside/outside) can be varied.
"""

__author__     = ['Mathias Bernhard']
__copyright__  = 'Copyright 2018 / Digital Building Technologies DBT / ETH Zurich'
__license__    = 'MIT License'
__email__      = '<bernhard@arch.ethz.ch>'

a = [abs(v + (side-0.5)*thickness) - thickness/2 for v in vals]
# ---------- end frepshell ----------
frepsubtraction_2 = FRepSubtraction(A=frepshell.a, B=frepbox.a)  # -> out, a; inputs A: list, B: list; same code as frepsubtraction

# ----
frepunion = FRepUnion(A=frepsubtraction.a, B=frepsubtraction_2.a)  # -> out, a; inputs A: list, B: list
# ---------- frepunion: Python ----------
#!/usr/bin/env python2
# -*- coding: utf-8 -*-

__author__     = ['Mathias Bernhard']
__copyright__  = 'Copyright 2018 / Digital Building Technologies DBT / ETH Zurich'
__license__    = 'MIT License'
__email__      = '<bernhard@arch.ethz.ch>'

a = [min(t) for t in zip(A,B)]
# ---------- end frepunion ----------

# ---- group: isosurface mesh generation
iso_surface = IsoSurface(
    Box=box,
    Values=frepunion.a,
    XResolution=freplandscape.nx,
    YResolution=freplandscape.ny,
    ZResolution=freplandscape.nz,
    IsoValue=0,
    MergeVertices=True)
preview = CustomPreview(Geometry=iso_surface, Shader=ColourSwatch(SwatchColor=RGB(252, 108, 133)))
