# Grasshopper definition 03_lattice.gh (Grasshopper 0.9.76)
# plug-ins: Python Interpreter

box = DomainBox(Base=PlaneXY(0, 0, 0), X="0 to 90", Y="-15 to 15", Z="0 to 90")
boxprop = BoxProperties(Box=box)  # -> Center, Diagonal, Area, Volume, Degeneracy
frepvoxelgrid = FRepVoxelGrid(box=box, dim=Slider(1, range=0..10))  # -> wbox, nx, ny, nz, pts
pt = Point(boxprop.Center)

# ---- group: generate spherical gradient
frepsphere = FRepSphere(center=pt, radius=Slider(30, range=0..100), pts=frepvoxelgrid.pts)  # -> out, a; inputs center: list of Point3d, radius: list, pts: list of Point3d
# ---------- frepsphere: Python ----------
#!/usr/bin/env python2
# -*- coding: utf-8 -*-

__author__     = ['Mathias Bernhard']
__copyright__  = 'Copyright 2018 / Digital Building Technologies DBT / ETH Zurich'
__license__    = 'MIT License'
__email__      = '<bernhard@arch.ethz.ch>'

"""
Creates one or multiple Sphere(s)
If multiple centers and one radius is fed in, all spheres are created with equal radius.
If only one center but multiple radii are fed in, only the biggest sphere is created (others are within).
If multiple centers and multiple radii are fed in, values are matched by index (shorter list).
Inputs:
    center: The center(s) of the sphere(s) (list)
    radius: The radius/radii for the sphere(s) (list)
    pts: List of points to query (list)
Output:
    a: Distance values for all points in pts
"""

import rhinoscriptsyntax as rs

# with multiple centers and only one radius,
# all spheres get the same radius
if len(radius)==1 and len(center)>1:
    radius = [radius[0] for _ in center]

# with only one center and multiple radii,
# only the biggest radius is considered
if len(center)==1 and len(radius)>1:
    radius = [max(radius)]

if len(radius) != len(center):
    num = min(len(radius),len(center))
    radius = radius[:num]
    center = center[:num]

a = [9999 for p in pts]
for i,c in enumerate(center):
    a = [min(a[j],rs.Distance(c,p)-radius[i]) for j,p in enumerate(pts)]
# ---------- end frepsphere ----------
division = Division(A=frepsphere.a, B=Slider(27, range=0..100))

# ---- group: generate gyroid lattice
frepgyroid = FRepGyroid(wavelength=Slider(7.5, range=0..100), pts=frepvoxelgrid.pts)  # -> out, a; inputs pts: list of Point3d
# ---------- frepgyroid: Python ----------
#!/usr/bin/env python2
# -*- coding: utf-8 -*-

__author__     = ['Mathias Bernhard']
__copyright__  = 'Copyright 2018 / Digital Building Technologies DBT / ETH Zurich'
__license__    = 'MIT License'
__email__      = '<bernhard@arch.ethz.ch>'

import rhinoscriptsyntax as rs
import math

fact = wavelength/math.pi
def get_dist(p):
    return math.sin(p[0]/fact)*math.cos(p[1]/fact) + math.sin(p[1]/fact)*math.cos(p[2]/fact) + math.sin(p[2]/fact)*math.cos(p[0]/fact)
    
a = [get_dist(p) for p in pts]
# ---------- end frepgyroid ----------

# ---- group: add gradient to lattice for offset
addition = Addition(A=frepgyroid.a, B=division)

# ---- group: intersect with box for closed borders
pl = PlaneNormal(Origin=pt, ZAxis=Vector(0, 0, 1))
frepbox = FRepBox(origin=pl, L="88", W="28", H="88", pts=frepvoxelgrid.pts)  # -> out, a; inputs origin: list of Plane, pts: list of Point3d
# ---------- frepbox: Python ----------
#!/usr/bin/env python2
# -*- coding: utf-8 -*-

"""
Creates a Box
Inputs:
    origin: The origin (plane) of the torus (list)
    L: the length of the box along X (float)
    W: the width of the box along Y (float)
    H: the height of the box along Z (float)
    fillet_radius: optional fillet radius for the edges (float)
    pts: List of points to query (list)
Output:
    a: Distance values for all points in pts
"""

__author__     = ['Mathias Bernhard']
__copyright__  = 'Copyright 2018 / Digital Building Technologies DBT / ETH Zurich'
__license__    = 'MIT License'
__email__      = '<bernhard@arch.ethz.ch>'

import rhinoscriptsyntax as rs
import Rhino.Geometry as rg
import math

def get_dist(p,o):
    dx = abs(p.X-o.OriginX) - (L/2-fillet_radius)
    dy = abs(p.Y-o.OriginY) - (W/2-fillet_radius)
    dz = abs(p.Z-o.OriginZ) - (H/2-fillet_radius)
    inside = max(dx,max(dy,dz)) - fillet_radius
    dx = max(dx,0)
    dy = max(dy,0)
    dz = max(dz,0)
    corner = math.pow(dx*dx + dy*dy + dz*dz,0.5) - fillet_radius
    if inside+fillet_radius>0:
        return corner
    else:
        return inside

# set default values
if not L:
    L=5
if not W:
    W=4
if not H:
    H=3
if not fillet_radius:
    fillet_radius = 0

a = [9999.9 for p in pts]
# calculate transformation matrix between worldxy and box plane
voxplane = rs.WorldXYPlane()
for o in origin:
    tpts = [rg.Point3d(p) for p in pts]
    voxplane.Origin = o.Origin
    tf = rg.Transform.PlaneToPlane(o,voxplane)
    
    # rebase the points according to the transformation matrix
    for p in tpts:
        p.Transform(tf)
    
    a = [min(a[j],get_dist(p,o)) for j,p in enumerate(tpts)]
# ---------- end frepbox ----------
frepintersection = FRepIntersection(A=addition, B=frepbox.a)  # -> out, a; inputs A: list, B: list
# ---------- frepintersection: Python ----------
#!/usr/bin/env python2
# -*- coding: utf-8 -*-

__author__     = ['Mathias Bernhard']
__copyright__  = 'Copyright 2018 / Digital Building Technologies DBT / ETH Zurich'
__license__    = 'MIT License'
__email__      = '<bernhard@arch.ethz.ch>'

a = [max(t) for t in zip(A,B)]
# ---------- end frepintersection ----------

# ----
frepisosurface = FRepIsosurface(box=frepvoxelgrid.wbox, a=frepintersection.a, nx=frepvoxelgrid.nx, ny=frepvoxelgrid.ny, nz=frepvoxelgrid.nz)  # -> out, A; inputs box: Box, a: list of Double, nx: Int32, ny: Int32, nz: Int32
# ---------- frepisosurface: C# ----------
    Mesh m = marchingCubesMesh(nx, ny, nz, a, 0.0);
    double dx = box.X[1] - box.X[0];
    double dy = box.Y[1] - box.Y[0];
    double dz = box.Z[1] - box.Z[0];
    m.Scale(dx / nx);
    // todo: box transform (non-uniform scale, translation)
    A = m;
# ---------- frepisosurface: C# additional code ----------
  public Mesh marchingCubesMesh(int nX, int nY, int nZ, List<double> values, double iso) {
    Mesh mesh = new Mesh();
    int nYZ = nY * nZ;
    int nVs = 0;
    int index = 0;
    double[] nbs = new double[8];
    int[] edges = new int[12];
    int[,] xEdges = new int[nY, nZ];
    int[,] yEdges = new int[nY, nZ];
    int[,] zEdges = new int[nY, nZ];
    int[,] yEdgesUp = new int[nY, nZ];
    int[,] zEdgesUp = new int[nY, nZ];

    // first pass: all have to be calculated
    // second pass: 2 becomes 1

    for (int x = 0; x < nX - 1; x++) {
      if (x == 0) {
        for (int y = 0; y < nY; y++) {
          for (int z = 0; z < nZ; z++) {
            index = z + y * nZ + x * nYZ;
            double cV = values[index];

            if (y < nY - 1) {
              double yNb = values[index + nZ];
              if (isBorder(cV, yNb, iso)) {
                mesh.Vertices.Add(x, getValue(iso, cV, yNb) + y, z);
                yEdges[y, z] = nVs;
                nVs++;
              }
            }
            if (z < nZ - 1) {
              double zNb = values[index + 1];
              if (isBorder(cV, zNb, iso)) {
                mesh.Vertices.Add(x, y, getValue(iso, cV, zNb) + z);
                zEdges[y, z] = nVs;
                nVs++;
              }
            }
          }
        }
      } else {
        // collecting the Vertices and Edges
        copyValuesFromAToB(yEdgesUp, yEdges);
        copyValuesFromAToB(zEdgesUp, zEdges);
      }
      for (int y = 0; y < nY; y++) {
        for (int z = 0; z < nZ; z++) {
          index = z + y * nZ + x * nYZ;
          double cV = values[index];

          double xNb = values[index + nYZ];
          if (isBorder(cV, xNb, iso)) {
            mesh.Vertices.Add(getValue(iso, cV, xNb) + x, y, z);
            xEdges[y, z] = nVs;
            nVs++;
          }

          index += nYZ;
          cV = values[index];

          if (y < nY - 1) {
            double yNb = values[index + nZ];
            if (isBorder(cV, yNb, iso)) {
              mesh.Vertices.Add(x + 1, getValue(iso, cV, yNb) + y, z);
              yEdgesUp[y, z] = nVs;
              nVs++;
            }
          }
          if (z < nZ - 1) {
            double zNb = values[index + 1];
            if (isBorder(cV, zNb, iso)) {
              mesh.Vertices.Add(x + 1, y, getValue(iso, cV, zNb) + z);
              zEdgesUp[y, z] = nVs;
              nVs++;
            }
          }
        }
      }

      // collecting the faces
      for (int y = 0; y < nY - 1; y++) {
        for (int z = 0; z < nZ - 1; z++) {
          int caseNumber = 0;
          index = z + y * nZ + x * nYZ;
          nbs[0] = values[index + nZ];
          nbs[1] = values[index + nYZ + nZ];
          nbs[2] = values[index + nYZ];
          nbs[3] = values[index];
          nbs[4] = values[index + nZ + 1];
          nbs[5] = values[index + nYZ + nZ + 1];
          nbs[6] = values[index + nYZ + 1];
          nbs[7] = values[index + 1];
          for (int i = 7; i > -1; i--) {
            if (nbs[i] > iso) {
              caseNumber++;
            }
            if (i > 0) {
              caseNumber = caseNumber << 1;
            }
          }

          edges[0] = xEdges[y + 1, z];
          edges[1] = yEdgesUp[y, z];
          edges[2] = xEdges[y, z];
          edges[3] = yEdges[y, z];

          edges[4] = xEdges[y + 1, z + 1];
          edges[5] = yEdgesUp[y, z + 1];
          edges[6] = xEdges[y, z + 1];
          edges[7] = yEdges[y, z + 1];

          edges[8] = zEdges[y + 1, z];
          edges[9] = zEdgesUp[y + 1, z];
          edges[10] = zEdges[y, z];
          edges[11] = zEdgesUp[y, z];

          int offset = caseNumber * 15;

          for (int i = offset; i < offset + 15; i += 3) {
            if (faces[i] > -1) {
              MeshFace fc = new MeshFace();

              fc.A = edges[faces[i + 0]];
              fc.B = edges[faces[i + 1]];
              fc.C = edges[faces[i + 2]];
              fc.D = fc.C;
              if (fc.IsTriangle){
                mesh.Faces.AddFace(fc);
              }
            }
          }
        }
      }
    }
    mesh.Normals.ComputeNormals();
    mesh.Compact();
    return mesh;
  }

  private void copyValuesFromAToB(int[,] array1, int[,] array2) {
    for (int i = 0; i < array1.GetLength(0); i++) {
      for (int j = 0; j < array1.GetLength(1); j++) {
        array2[i, j] = array1[i, j];
      }
    }
  }

  private double getValue(double iso, double v1, double v2) {
    if (Math.Abs(v2 - v1) < 0.0000001f) {
      return 0;
    }
    return (iso - v1) / (v2 - v1);
  }

  private bool isBorder(double v1, double v2, double iso){
    if (v1 > iso && v2 <= iso)return true;
    if (v2 > iso && v1 <= iso)return true;
    return false;
  }

  private static int[] faces = new int[] {
    -1, -1, -1, -1, -1, -1, -1, -1, -1, -1, -1,-1, -1, -1, -1,
    0, 8, 3, -1, -1, -1, -1, -1, -1, -1, -1, -1, -1,-1, -1,
    0, 1, 9, -1, -1, -1, -1, -1, -1, -1, -1, -1, -1, -1, -1,
    1,8, 3, 9, 8, 1, -1, -1, -1, -1, -1, -1, -1, -1, -1,
    1, 2, 11, -1,-1, -1, -1, -1, -1, -1, -1, -1, -1, -1, -1,
    0, 8, 3, 1, 2, 11, -1,-1, -1, -1, -1, -1, -1, -1, -1,
    9, 2, 11, 0, 2, 9, -1, -1, -1, -1,
    -1, -1, -1, -1, -1, 2, 8, 3, 2, 11, 8, 11, 9, 8, -1, -1, -1, -1,
    -1, -1, 3, 10, 2, -1, -1, -1, -1, -1, -1, -1, -1, -1, -1, -1, -1,
    0, 10, 2, 8, 10, 0, -1, -1, -1, -1, -1, -1, -1, -1, -1, 1, 9, 0, 2,
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# ---------- end frepisosurface ----------
preview = CustomPreview(Geometry=frepisosurface.A, Shader=ColourSwatch(SwatchColor=RGB(252, 108, 133)))

# ==== cluster FRepVoxelGrid: Creates the initial grid of voxels. Outputs number of cells in X, Y and Z and a list of query points.
box = ClusterInput()
box_corners = BoxCorners(Box=box)  # -> CornerA, CornerB, CornerC, CornerD, CornerE, CornerF, CornerG, CornerH
bbox = BoundingBox(
    Content=[box_corners.CornerA, box_corners.CornerB, box_corners.CornerC, box_corners.CornerD, box_corners.CornerE, box_corners.CornerF, box_corners.CornerG, box_corners.CornerH],
    Plane=PlaneXY(0, 0, 0),
    UnionBox=True)  # -> wBox, B
dim = ClusterInput()
c_script = CSharpScript(Box=bbox.wBox, dim=dim)  # -> out, nx, ny, nz, pts; inputs Box: Box, dim: Double
# ---------- c_script: C# ----------
    double dx = Box.X[1] - Box.X[0];
    double dy = Box.Y[1] - Box.Y[0];
    double dz = Box.Z[1] - Box.Z[0];

    int nxt = (int) Math.Round(dx / dim);
    int nyt = (int) Math.Round(dy / dim);
    int nzt = (int) Math.Round(dz / dim);

    double dimx = dx / nxt;
    double dimy = dy / nyt;
    double dimz = dz / nzt;

    nx = nxt;
    ny = nyt;
    nz = nzt;

    Point3d[] res = new Point3d[nxt * nyt * nzt];
    int i = 0;
    for (int x = 0; x < nxt; x++) {
      for (int y = 0; y < nyt; y++) {
        for (int z = 0; z < nzt; z++) {
          double px = dimx / 2 + Box.Center[0] - dx / 2 + x * dimx;
          double py = dimy / 2 + Box.Center[1] - dy / 2 + y * dimy;
          double pz = dimz / 2 + Box.Center[2] - dz / 2 + z * dimz;
          res[i] = new Point3d(px, py, pz);
          i++;
        }
      }
    }
    pts = res;
# ---------- c_script: C# additional code ----------
  /// <summary>
  /// This method will be called once every solution, before any calls to RunScript.
  /// </summary>
  public override void BeforeRunScript()
  { }
  /// <summary>
  /// This method will be called once every solution, after any calls to RunScript.
  /// </summary>
  public override void AfterRunScript()
  { }
# ---------- end c_script ----------
wbox = ClusterOutput(bbox.wBox)
nx = ClusterOutput(c_script.nx)
ny = ClusterOutput(c_script.ny)
nz = ClusterOutput(c_script.nz)
pts = ClusterOutput(c_script.pts)
