# Grasshopper definition 03_node.gh (Grasshopper 1.0.7)

crv = Curve(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)
crv_2 = Curve([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])
crv_3 = Curve(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)
pframe = PerpFrame(Curve=reparameterize(crv_3), Parameter="0.5")
pframe_2 = PerpFrame(Curve=reparameterize(crv), Parameter="0.4")
pframe_3 = PerpFrame(Curve=reparameterize(crv_2), Parameter="0.5")
axcylinder = AxCylinder(r="16", h="140", p=pframe)  # -> out, d; inputs p: Plane
# ---------- axcylinder: Python ----------
"""Creates a cylinder.
    Inputs:
        r: radius of the cylinder
        h: height of the cylinder
        p: plane of origin
    Output:
        d: the cylinder object (sdf)"""

__author__     = ['Mathias Bernhard']
__copyright__  = 'Copyright 2018 / Digital Building Technologies DBT'
__license__    = 'MIT License'
__email__      = ['<bernhard@arch.ethz.ch>']

import rhinoscriptsyntax as rs
import Rhino.Geometry as rg
import math

class Cylinder(object):
    """
    this is the cylinder class
    """
    def __init__(self, r=1, h=1):
        self.loc = rg.Vector3f(0,0,0)
        self.plane = None
        self.transform = None
        self.r = r
        self.h = h

    def set_plane(self, p):
        self.plane = p
        matrix = rg.Transform.PlaneToPlane(rg.Plane.WorldXY, self.plane)
        success, self.transform = matrix.TryGetInverse()

    def get_distance(self,x,y,z):
        """
        distance function
        """
        if self.transform is not None:
            p = rg.Point3f(x,y,z)
            p.Transform(self.transform)
            dx = p.X
            dy = p.Y
            dz = abs(p.Z)
        else:
            dx, dy, dz = x, y, abs(z)

        # 2d circle distance
        dxy = math.sqrt(dx**2 + dy**2) - self.r
        # cut with cap plances
        d = max(dxy, dz-self.h/2.0)
        return d

if __name__=="__main__":
    if r is None:
        r = 1.0
    if h is None:
        h = 2.0
    d = Cylinder(r,h)
    if p is not None:
        d.set_plane(p)
# ---------- end axcylinder ----------
axcylinder_2 = AxCylinder(r="13", h="96", p=pframe_2)  # -> out, d; inputs p: Plane; same code as axcylinder
axbox = AxBox(a="25", b="20", c="55", r="1.5", p=pframe_3)  # -> out, d; inputs p: Plane
# ---------- axbox: Python ----------
"""Creates a box with an optional edge fillet.
    Inputs:
        a: length along the x axis
        b: length along the y axis
        c: length along the z axis
        r: edge fillet radius
        p: plane of origin of the box
    Output:
        d: the box object (sdf)"""

__author__     = ['Mathias Bernhard']
__copyright__  = 'Copyright 2018 / Digital Building Technologies DBT'
__license__    = 'MIT License'
__email__      = ['<bernhard@arch.ethz.ch>']

import rhinoscriptsyntax as rs
import Rhino.Geometry as rg
import math

class RBox(object):
    """
    this is the box class
    """
    def __init__(self, a=1, b=1, c=1, r=0):
        self.a = a
        self.b = b
        self.c = c
        self.r = r
        self.plane = None
        self.transform = None

    def set_plane(self, p):
        self.plane = p
        matrix = rg.Transform.PlaneToPlane(rg.Plane.WorldXY, self.plane)
        success, self.transform = matrix.TryGetInverse()

    def get_distance(self,x,y,z):
        """
        distance function
        """
        if self.transform is not None:
            p = rg.Point3f(x,y,z)
            p.Transform(self.transform)
            x = p.X
            y = p.Y
            z = p.Z

        dx = abs(x)-(self.a/2.0-self.r)
        dy = abs(y)-(self.b/2.0-self.r)
        dz = abs(z)-(self.c/2.0-self.r)
        inside = max([dx,dy,dz])-self.r
        dx = max(dx,0)
        dy = max(dy,0)
        dz = max(dz,0)
        if inside+self.r>0:
            #rounded corner case
            return math.sqrt(dx**2 + dy**2 + dz**2) - self.r
        else:
            return inside


if __name__=="__main__":
    if a is None:
        a = 2
    if b is None:
        b = 3
    if c is None:
        c = 4
    if r is None:
        r = 0
    d = RBox(a,b,c,r)
    if p is not None:
        d.set_plane(p)
# ---------- end axbox ----------
number_slider = Slider(7, range=0..10)
axunion = AxUnion(a=axbox.d)  # -> out, d; inputs a: list
# ---------- axunion: Python ----------
"""Creates a Boolean union.
    Inputs:
        a: list of / single sdf object(s)
        b: second sdf object
    Output:
        d: the union object (sdf)"""

__author__     = ['Mathias Bernhard']
__copyright__  = 'Copyright 2018 / Digital Building Technologies DBT'
__license__    = 'MIT License'
__email__      = ['<bernhard@arch.ethz.ch>']

import rhinoscriptsyntax as rs

class Union(object):
    """
    boolean union of two or more objects
    """
    def __init__(self, obja=None, objb=None):
        if type(obja)==type([]):
            self.objs = obja
        else:
            self.objs = [obja,objb]
        
    def get_distance(self,x,y,z):
        ds = [o.get_distance(x,y,z) for o in self.objs]
        return min(ds)

if __name__=="__main__":
    if len(a)>0:
        if len(a)==1:
            if b is not None:
                d = Union(a[0],b)
        else:
            d = Union(a)
# ---------- end axunion ----------
axblend = AxBlend(a=axcylinder.d, b=axcylinder_2.d, f=number_slider)  # -> out, d
# ---------- axblend: Python ----------
"""Creates a smooth blend union.
    Inputs:
        a: first sdf object
        b: second sdf object
        f: smoothing factor (default 2.0)
    Output:
        d: the blend object (sdf)"""

__author__     = ['Mathias Bernhard']
__copyright__  = 'Copyright 2018 / Digital Building Technologies DBT'
__license__    = 'MIT License'
__email__      = ['<bernhard@arch.ethz.ch>']

import rhinoscriptsyntax as rs

class Blend(object):
    """
    smooth blend between a and b
    """
    def __init__(self, obja, objb, r=2.0):
        self.a = obja
        self.b = objb
        self.r = r
        
    def get_distance(self,x,y,z):
        da = self.a.get_distance(x,y,z)
        db = self.b.get_distance(x,y,z)
        e = max(self.r - abs(da-db), 0)
        return min(da,db) - e*e*0.25/self.r

if __name__=="__main__":
    if a is not None and b is not None:
        if f is None:
            f = 2.0
        d = Blend(a,b,f)
# ---------- end axblend ----------
axblend_2 = AxBlend(a=axblend.d, b=axunion.d, f=number_slider)  # -> out, d; same code as axblend
axtpms = AxTPMS(w="4.0")  # -> out, d, n; inputs i: Int32
# ---------- axtpms: Python ----------
"""Creates a micro-structure / lattice using triply periodic minimal surfaces (TMPS).
    Inputs:
        i: index > 0: Gyroid / 1: SchwartzP / 2: Diamond / 3: FischerKoch
        w: the wavelength
    Output:
        d: the lattice object (sdf)
        n: list of TPMS names"""

__author__     = ['Mathias Bernhard']
__copyright__  = 'Copyright 2018 / Digital Building Technologies DBT / ETH Zurich'
__license__    = 'MIT License'
__email__      = ['<bernhard@arch.ethz.ch>']

import math

class TPMS(object):
    def __init__(self, w=10.0):
        self.wl = w
        self.fact = self.wl/(math.pi)

    def get_distance(self,x,y,z):
        px = x/self.fact
        py = y/self.fact
        pz = z/self.fact
        return self.get_value(px,py,pz)

    def get_value(self,x,y,z):
        return 0

class Gyroid(TPMS):
    def get_value(self,px,py,pz):
        return math.sin(px)*math.cos(py) + math.sin(py)*math.cos(pz) + math.sin(pz)*math.cos(px)

class SchwartzP(TPMS):
    def get_value(self,px,py,pz):
        return math.cos(px)+math.cos(py)+math.cos(pz)

class Diamond(TPMS):
    def get_value(self,px,py,pz):
        return (
            math.sin(px) * math.sin(py) * math.sin(pz) +
            math.sin(px) * math.cos(py) * math.cos(pz) +
            math.cos(px) * math.sin(py) * math.cos(pz) +
            math.cos(px) * math.cos(py) * math.sin(pz))

class FischerKoch(TPMS):
    def get_value(self,px,py,pz):
        return (
            math.cos(2*px) * math.sin(py) * math.cos(pz) +
            math.cos(2*py) * math.sin(pz) * math.cos(px) +
            math.cos(2*pz) * math.sin(px) * math.cos(py))

class Lidinoid(TPMS):
    def get_value(self,px,py,pz):
        return (0.5 * (
            math.sin(2 * px) * math.cos(py) * math.sin(pz) +
            math.sin(2 * py) * math.cos(pz) * math.sin(py) +
            math.sin(2 * pz) * math.cos(px) * math.sin(py) ) - 
            0.5 * (
            math.cos(2 * px) * math.cos(2 * py) +
            math.cos(2 * py) * math.cos(2 * pz) +
            math.cos(2 * pz) * math.cos(2 * px)) + 0.15)

class Neovius(TPMS):
    def get_value(self,px,py,pz):
        return (
	    3 * (math.cos(px) + math.cos(py) + math.cos(pz)) +
	    4 *  math.cos(px) * math.cos(py) * math.cos(pz))


if __name__=="__main__":
    if w is None:
        w = 10.0
    tpms = [Gyroid(w),SchwartzP(w),Diamond(w),FischerKoch(w),Lidinoid(w),Neovius(w)]
    if i is None:
        i = 0
    i = max(0,min(i,len(tpms)-1))
    d = tpms[i]
    n = ["Gyroid", "SchwartzP", "Diamond", "FischerKoch", "Lidinoid", "Neovius"]
# ---------- end axtpms ----------
axintersection = AxIntersection(a=axtpms.d, b=axblend_2.d)  # -> out, d; inputs a: list
# ---------- axintersection: Python ----------
"""Creates a Boolean intersection.
    Inputs:
        a: list of / single sdf object(s)
        b: second sdf object
    Output:
        d: the intersection object (sdf)"""

__author__     = ['Mathias Bernhard']
__copyright__  = 'Copyright 2018 / Digital Building Technologies DBT'
__license__    = 'MIT License'
__email__      = ['<bernhard@arch.ethz.ch>']

import rhinoscriptsyntax as rs

class Intersection(object):
    """
    boolean intersection of two or more objects
    """
    def __init__(self, obja=None, objb=None):
        if type(obja)==type([]):
            self.objs = obja
        else:
            self.objs = [obja,objb]

    def get_distance(self,x,y,z):
        ds = [o.get_distance(x,y,z) for o in self.objs]
        return max(ds)

if __name__=="__main__":
    if len(a)>0:
        if len(a)==1:
            if b is not None:
                d = Intersection(a[0],b)
        else:
            d = Intersection(a)
# ---------- end axintersection ----------
axshell = AxShell(x=axblend_2.d, t="3.0", s="1.0")  # -> out, d
# ---------- axshell: Python ----------
"""Creates a shell from a solid.
    Inputs:
        x: the solid sdf object
        t: thickness of the shell
        s: side factor (1: inside, 0.5: half/half, 0: outside)
    Output:
        d: the shell object (sdf)"""

__author__     = ['Mathias Bernhard']
__copyright__  = 'Copyright 2018 / Digital Building Technologies DBT'
__license__    = 'MIT License'
__email__      = ['<bernhard@arch.ethz.ch>']

import rhinoscriptsyntax as rs

class Shell(object):
    """
    creates a shell of thickness d
    side factor s:
        1.0 > inside
        0.5 > half half
        0.0 > outside
    """

    def __init__(self, obj, d=1.0, s=0.0):
        self.o = obj
        self.d = d
        self.s = s

    def get_distance(self,x,y,z):
        do = self.o.get_distance(x,y,z)
        return abs(do + (self.s-0.5)*self.d)-self.d/2.0

if __name__=="__main__":
    if x is not None:
        if t is None:
            t = 1.0
        if s is None:
            s = 0.5
        d = Shell(x,t,s)
# ---------- end axshell ----------
axunion_2 = AxUnion(a=axintersection.d, b=axshell.d)  # -> out, d; inputs a: list; same code as axunion
axcylinder_3 = AxCylinder(r="13", h="140", p=pframe)  # -> out, d; inputs p: Plane; same code as axcylinder
axsubtraction = AxSubtraction(a=axunion_2.d, b=axcylinder_3.d)  # -> out, d
# ---------- axsubtraction: Python ----------
"""Creates a Boolean subtraction a-b.
    Inputs:
        a: sdf object to subtract from
        b: sdf object to subtract
    Output:
        d: the subtraction/difference object (sdf)"""

__author__     = ['Mathias Bernhard']
__copyright__  = 'Copyright 2018 / Digital Building Technologies DBT'
__license__    = 'MIT License'
__email__      = ['<bernhard@arch.ethz.ch>']

import rhinoscriptsyntax as rs

class Subtraction(object):
    """
    boolean subtraction of a minus b
    """
    def __init__(self, obja, objb):
        self.a = obja
        self.b = objb
        
    def get_distance(self,x,y,z):
        da = self.a.get_distance(x,y,z)
        db = self.b.get_distance(x,y,z)
        return max(da,-db)

if __name__=="__main__":
    if a is not None and b is not None:
        d = Subtraction(a,b)
        print d.get_distance(3,4,5)
# ---------- end axsubtraction ----------

pt = Point(Point(50, 50, 50))

pl = PlaneNormal(Origin=pt, ZAxis=Vector(0, 0, 1))
axbox_2 = AxBox(a="95", b="95", c="95", p=pl)  # -> out, d; inputs p: Plane; same code as axbox
axintersection_2 = AxIntersection(a=axbox_2.d, b=axsubtraction.d)  # -> out, d; inputs a: list; same code as axintersection

axoctree = AxOctree(x=axintersection_2.d, p=pt, d="100", n=Slider(4, range=0..10))  # -> out, t; inputs p: Point3d, n: Int32
# ---------- axoctree: Python ----------
"""Creates a sparse voxel octree (SVO) subdivision.
    Inputs:
        x: the sdf object used for distance calculation
        p: the center point of the root node (default: 0,0,0)
        d: the edge length of the root node (default: 6.0)
        n: the maximum number of subdivisions (default: 4)
    Output:
        t: the octree object, t.leafs is a list of leaf nodes (for MC meshing)"""

__author__     = ['Mathias Bernhard']
__copyright__  = 'Copyright 2018 / Digital Building Technologies DBT / ETH Zurich'
__license__    = 'MIT License'
__email__      = ['<bernhard@arch.ethz.ch>']

import rhinoscriptsyntax as rs
import Rhino.Geometry as rg
from math import sqrt

class OcTree(object):
    """
    sparse voxel octree (SVO) class for adaptive subdivision
    """
    def __init__(self, pt, ws):
        self.worldsize = float(ws)
        self.maxlevels = 3
        #self.sqrt2 = sqrt(2.0)
        self.sqrt3 = sqrt(3.0)
        self.pos = pt
        self.rootnode = OctNode(pt.X,pt.Y,pt.Z, ws, 0)
        self.distobj = None
        self.leafs = []

    def set_level(self, n):
        self.maxlevels = int(n)

    def divide(self, node):
        d = self.distobj.get_distance(node.pos.X, node.pos.Y, node.pos.Z)
        node.distance = d

        if node.level < self.maxlevels:
            if abs(d) < self.sqrt3 * node.edge/2.0:
                node.divide_node()
                for b in node.branches:
                    self.divide(b)
        else:
            if abs(node.distance) < self.sqrt3 * node.edge/2.0:
                self.leafs.append(node)

class OctNode(object):
    """
    node of octree that is either leaf node
    or has 8 child nodes as branches
    """
    def __init__(self, x,y,z, s, l):
        self.pos = rg.Vector3f(x,y,z)
        self.edge = s
        self.level = l
        self.branches = None
        self.distance = 0.0

    def divide_node(self):
        self.branches = []
        qs = self.edge/4.0
        nl = self.level + 1
        self.branches.append(OctNode(self.pos.X-qs, self.pos.Y-qs, self.pos.Z-qs, qs*2, nl))
        self.branches.append(OctNode(self.pos.X+qs, self.pos.Y-qs, self.pos.Z-qs, qs*2, nl))
        self.branches.append(OctNode(self.pos.X-qs, self.pos.Y+qs, self.pos.Z-qs, qs*2, nl))
        self.branches.append(OctNode(self.pos.X+qs, self.pos.Y+qs, self.pos.Z-qs, qs*2, nl))
        self.branches.append(OctNode(self.pos.X-qs, self.pos.Y-qs, self.pos.Z+qs, qs*2, nl))
        self.branches.append(OctNode(self.pos.X+qs, self.pos.Y-qs, self.pos.Z+qs, qs*2, nl))
        self.branches.append(OctNode(self.pos.X-qs, self.pos.Y+qs, self.pos.Z+qs, qs*2, nl))
        self.branches.append(OctNode(self.pos.X+qs, self.pos.Y+qs, self.pos.Z+qs, qs*2, nl))

if __name__=="__main__":
    if x is not None:
        if p is None:
            p = rg.Point3f(0,0,0)
        if d is None:
            d = 6.0
        if n is None:
            n = 4
        t = OcTree(p,d)
        t.distobj = x
        t.set_level(n)
        t.divide(t.rootnode)
# ---------- end axoctree ----------
axmcubeoctree = AxMCubeOctree(t=axoctree.t)  # -> out, m, p
# ---------- axmcubeoctree: Python ----------
"""Creates a marching cubes isosurface.
    Inputs:
        t: the subdivided octree
    Output:
        m: the isosurface mesh
        p: the leaf node center points (for debugging)"""

__author__     = ['Mathias Bernhard']
__copyright__  = 'Copyright 2018 / Digital Building Technologies DBT'
__license__    = 'MIT License'
__email__      = ['<bernhard@arch.ethz.ch>']

import rhinoscriptsyntax as rs
import Rhino.Geometry as rg

# From BorisTheBrave
# blog: https://www.boristhebrave.com/2018/04/15/marching-cubes-3d-tutorial/
# repo: https://github.com/BorisTheBrave/mc-dc/

# My convention for vertices is:
VERTICES = [
    (0, 0, 0),
    (1, 0, 0),
    (1, 1, 0),
    (0, 1, 0),
    (0, 0, 1),
    (1, 0, 1),
    (1, 1, 1),
    (0, 1, 1),
]


# My convention for the edges
EDGES = [
    (0, 1),
    (1, 2),
    (2, 3),
    (3, 0),
    (4, 5),
    (5, 6),
    (6, 7),
    (7, 4),
    (0, 4),
    (1, 5),
    (2, 6),
    (3, 7),
]

# Table driven approach to the 256 combinations. Pro-tip, don't write this by hand, copy mine!
# See marching_cubes_gen.py for how I generated these.
# Each index is the bitwise representation of what is solid.
# Each value is a list of triples indicating what edges are used for that triangle
# (Recall each edge of the cell may become a vertex in the output boundary)
cases = [[],
 [[8, 0, 3]],
 [[1, 0, 9]],
 [[8, 1, 3], [8, 9, 1]],
 [[10, 2, 1]],
 [[8, 0, 3], [1, 10, 2]],
 [[9, 2, 0], [9, 10, 2]],
 [[3, 8, 2], [2, 8, 10], [10, 8, 9]],
 [[3, 2, 11]],
 [[0, 2, 8], [2, 11, 8]],
 [[1, 0, 9], [2, 11, 3]],
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 []]

ADAPTIVE = True
def adapt(v0, v1):
    """v0 and v1 are numbers of opposite sign. This returns how far you need to interpolate from v0 to v1 to get to 0."""
    assert (v1 > 0) != (v0 > 0), "v0 and v1 do not have opposite sign"
    if ADAPTIVE:
        return (0 - v0) / (v1 - v0)
    else:
        return 0.5

def marching_cubes_3d_single_cell(f, x, y, z, el):
    # Evaluate f on each vertex of the cube
    # el (edge length) addition by mathias bernhard
    f_eval = [None] * 8
    for v in range(8):
        v_pos = VERTICES[v]
        f_eval[v] = f(x + (v_pos[0]-0.5)*el, y + (v_pos[1]-0.5)*el, z + (v_pos[2]-0.5)*el)
    # Determine which case we are
    case = sum(2**v for v in range(8) if f_eval[v] > 0)
    # Ok, what faces do we need (in terms of edges)
    faces = cases[case]

    def edge_to_boundary_vertex(edge):
        """Returns the vertex in the middle of the specified edge"""
        # Find the two vertices specified by this edge, and interpolate between
        # them according to adapt, as in the 2d case
        v0, v1 = EDGES[edge]
        f0 = f_eval[v0]
        f1 = f_eval[v1]
        t0 = (1 - adapt(f0, f1))
        t1 = (1 - t0)
        vert_pos0 = VERTICES[v0]
        vert_pos1 = VERTICES[v1]
        return rg.Vector3f(x + ((vert_pos0[0]) * t0 + (vert_pos1[0]) * t1 - 0.5) * el,
                    y + ((vert_pos0[1]) * t0 + (vert_pos1[1]) * t1 - 0.5) * el,
                    z + ((vert_pos0[2]) * t0 + (vert_pos1[2]) * t1 - 0.5) * el)

    if len(faces)>0:
        m = rg.Mesh()
        for face in faces:
            # For each face, find the vertices of that face, and output it.
            # We make no effort to re-use vertices between multiple faces,
            # A fancier implementation might do so.
            edges = face
            verts = list(map(edge_to_boundary_vertex, edges))
            #nvi = len(m.Vertices)
            nvi = m.Vertices.Count # thanks, SP!
            for n in verts:
                m.Vertices.Add(n.X,n.Y,n.Z)
            f = rg.MeshFace(nvi+0,nvi+1,nvi+2)
            m.Faces.AddFace(f)
        return m
    
if __name__=="__main__":
    if t is not None:
        p = [l.pos for l in t.leafs]
        tm = rg.Mesh()
        for l in t.leafs:
            cm = marching_cubes_3d_single_cell(t.distobj.get_distance,
                                               l.pos.X, l.pos.Y, l.pos.Z, l.edge)
            if cm is not None:
                tm.Append(cm)
        tm.Vertices.CombineIdentical(True,True)
        
        # validate mesh by removing faces with two identical vertex indices
        m = rg.Mesh()
        m.Vertices.AddVertices(tm.Vertices)
        for i in range(tm.Faces.Count):
            f = tm.Faces[i]
            if len(set(f))<3:
                print i,len(set(f))
            else:
                m.Faces.AddFace(f)
        
        m.Normals.ComputeNormals()
        m.Compact()
# ---------- end axmcubeoctree ----------
preview = CustomPreview(Geometry=axmcubeoctree.m, Material=ColourSwatch(SwatchColor=RGB(238, 103, 121)))
