# Grasshopper definition 04_crossnode.gh (Grasshopper 1.0.4)
# plug-ins: Python Interpreter

# ---- group: create voxel space
box = DomainBox(Base=PlaneXY(0, 0, 0), X="-20 to 20", Y="-20 to 20", Z="-20 to 20")
edges = BrepEdges(Brep=box)  # -> Naked, Interior, NonManifold
axvoxelgrid = AxVoxelGrid(box=box, dim=Slider(1.2, range=0..10))  # -> wbox, nx, ny, nz, pts

# ----
number_slider = Slider(7.5, range=0..10)
number_slider_2 = Slider(45, range=0..100)

# ---- group: rhombic shape
X = UnitX(Factor=1)
pl = PlaneNormal(Origin=Point(0, 0, 0), ZAxis=X)
rotate = Rotate(Geometry=pl, Angle=Slider(0.785, range=0..1), Plane=pl)  # -> Geometry, Transform
multiplication = Multiplication(A=number_slider, B=1.8)
axbox = AxBox(origin=rotate.Geometry, L=multiplication, W=multiplication, H=number_slider_2, pts=axvoxelgrid.pts)  # -> out, a; inputs origin: list of Plane, pts: list of Point3d
# ---------- axbox: Python ----------
#!/usr/bin/env python2
# -*- coding: utf-8 -*-

"""
Creates a Box
Inputs:
    origin: The origin (plane) of the torus (list)
    L: the length of the box along X (float)
    W: the width of the box along Y (float)
    H: the height of the box along Z (float)
    fillet_radius: optional fillet radius for the edges (float)
    pts: List of points to query (list)
Output:
    a: Distance values for all points in pts
"""

__author__     = ['Mathias Bernhard']
__copyright__  = 'Copyright 2018 / Digital Building Technologies DBT / ETH Zurich'
__license__    = 'MIT License'
__email__      = '<bernhard@arch.ethz.ch>'

import rhinoscriptsyntax as rs
import Rhino.Geometry as rg
import math

def get_dist(p,o):
    dx = abs(p.X-o.OriginX) - (L/2-fillet_radius)
    dy = abs(p.Y-o.OriginY) - (W/2-fillet_radius)
    dz = abs(p.Z-o.OriginZ) - (H/2-fillet_radius)
    inside = max(dx,max(dy,dz)) - fillet_radius
    dx = max(dx,0)
    dy = max(dy,0)
    dz = max(dz,0)
    corner = math.pow(dx*dx + dy*dy + dz*dz,0.5) - fillet_radius
    if inside+fillet_radius>0:
        return corner
    else:
        return inside

# set default values
if not origin:
	origin = [rs.WorldXYPlane()]
if not L:
    L=5
if not W:
    W=4
if not H:
    H=3
if not fillet_radius:
    fillet_radius = 0

a = [9999.9 for p in pts]
# calculate transformation matrix between worldxy and box plane
voxplane = rs.WorldXYPlane()
for o in origin:
    tpts = [rg.Point3d(p) for p in pts]
    voxplane.Origin = o.Origin
    tf = rg.Transform.PlaneToPlane(o,voxplane)
    
    # rebase the points according to the transformation matrix
    for p in tpts:
        p.Transform(tf)
    
    a = [min(a[j],get_dist(p,o)) for j,p in enumerate(tpts)]
# ---------- end axbox ----------

# ---- group: star shape
division = Division(A=number_slider_2, B=2)
pt = ConstructPoint(XCoordinate=0, YCoordinate=division, ZCoordinate=0)
pt_2 = ConstructPoint(XCoordinate=0, YCoordinate=expr("X*-1", division), ZCoordinate=0)
ln = Line(StartPoint=pt, EndPoint=pt_2)
multiplication_2 = Multiplication(A=number_slider, B="1.4")
axpipepoly = AxPipePoly(axis=ln, n="5", r=number_slider, r2=multiplication_2, pts=axvoxelgrid.pts)  # -> out, a; inputs axis: Curve, n: Int32, pts: list of Point3d
# ---------- axpipepoly: Python ----------
#!/usr/bin/env python2
# -*- coding: utf-8 -*-

"""
extrudes a star polygon along a curve
Inputs:
    axis: the axis curve
    n : the number of points in the polygon (doubles when star)
    r : the radius of the polygon
    r2 : second radius to create a star polygon
    sa : rotation angle at start (0 if omitted)
    ea : rotation angle at end (same as sa if omitted)
    pts: List of points to query (list)
Output:
    a: Distance values for all points in pts
"""

__author__     = ['Mathias Bernhard']
__copyright__  = 'Copyright 2018 / Digital Building Technologies DBT / ETH Zurich'
__license__    = 'MIT License'
__email__      = '<bernhard@arch.ethz.ch>'

import rhinoscriptsyntax as rs
import Rhino.Geometry as rg
import math

# check input
if not n:
	n=6
if n<3:
	n=3
if not r:
	r = 10
if r<0:
	r = math.abs(r)
if not sa:
    sa = 0
if not ea:
    ea = sa

if r2:
	n*=2

def get_dist(pt,poly):
    # find closest point on axis curve
    param = rs.CurveClosestPoint(axis, pt)
    # get plane perpendicular to curve
    ck,pl = axis.PerpendicularFrameAt(param)
    # part responsible for flat end caps
    # if distance from point to plane is bigger than 0,
    # return that distance
    pp = rs.PlaneClosestPoint(pl,pt)
    d2 = rs.Distance(pt,pp)
    if d2>0.01:
        return d2
        
    # else change the basis of the polygon from world xy
    # to that plane to check for distance and inside/outside
    pm = (param-axis.Domain[0])/(axis.Domain[1]-axis.Domain[0])
    
    wxy = rs.WorldXYPlane()
    tf = rg.Transform.PlaneToPlane(wxy,pl)
    ang = sa + pm*(ea-sa)
    tr = rg.Transform.Rotation(ang, pl.Normal, pl.Origin)
    tpts = rs.CurvePoints(poly)
    for p in tpts:
        p.Transform(tf)
        p.Transform(tr)
    ply = rs.AddPolyline(tpts)
    prm = rs.CurveClosestPoint(ply,pt)
    cp = rs.EvaluateCurve(ply,prm)
    d = rs.Distance(pt,cp)
    # if the point is inside the curve, reverse the distance
    bln = rs.PointInPlanarClosedCurve(pt,ply,pl)
    if bln:
        d *= -1
    return d

def get_polygon():
	ai = 2*math.pi / n
	plpts = []
	for s in range(n+1):
		if r2:
			rt = ((s+1)%2)*r+(s%2)*r2
		else:
			rt = r
		x = rt * math.cos(s*ai)
		y = rt * math.sin(s*ai)
		plpts.append(rg.Point3d(x,y,0))
	return rs.AddPolyline(plpts)

ply = get_polygon()

a = [get_dist(p,ply) for p in pts]
# ---------- end axpipepoly ----------

# ---- group: cylinder shape
axcylinder = AxCylinder(radius=number_slider, height=number_slider_2, pts=axvoxelgrid.pts)  # -> out, a; inputs origin: list of Plane, radius: list, height: list, pts: list of Point3d
# ---------- axcylinder: Python ----------
#!/usr/bin/env python2
# -*- coding: utf-8 -*-

"""
Creates cylinders centered aroung the origin planes.
If only one radius is specified, it is used for all the cylinders.
If only one height is specified, it is used for all the cylinders.
"""

__author__     = ['Mathias Bernhard']
__copyright__  = 'Copyright 2018 / Digital Building Technologies DBT / ETH Zurich'
__license__    = 'MIT License'
__email__      = '<bernhard@arch.ethz.ch>'

import rhinoscriptsyntax as rs
import Rhino.Geometry as rg
import math

def get_dist(p,o,r,h):
    dx = abs(p.X-o.OriginX)
    dy = abs(p.Y-o.OriginY)
    dz = abs(p.Z-o.OriginZ)
    
    d = math.sqrt(dx*dx + dy*dy) - r
    d = max(d, abs(dz) - h/2)
    return d

# check inputs
if not origin:
	origin = [rs.WorldXYPlane()]
if not radius:
    radius = [5.0 for _ in origin]
if not height:
    height = [15.0 for _ in origin]
if len(radius)<len(origin):
    radius = [radius[0] for _ in origin]
if len(height)<len(origin):
    height = [height[0] for _ in origin]

# calculate transformation matrix between worldxy and box plane
voxplane = rs.WorldXYPlane()
a = [9999.9 for p in pts]
for i,o in enumerate(origin):
    tpts = [rg.Point3d(p) for p in pts]
    voxplane.Origin = o.Origin
    tf = rg.Transform.PlaneToPlane(o,voxplane)
    
    # rebase the points according to the transformation matrix
    for p in tpts:
        p.Transform(tf)
    
    a = [min(a[j],get_dist(p,o,radius[i],height[i])) for j,p in enumerate(tpts)]
# ---------- end axcylinder ----------

# ---- group: blend 3 objects
number_slider_3 = Slider(0.4, range=0..1)
axblend = AxBlend(A=axcylinder.a, B=axbox.a, k=number_slider_3)  # -> out, a; inputs A: list, B: list
# ---------- axblend: Python ----------
#!/usr/bin/env python2
# -*- coding: utf-8 -*-

"""
adds two objects A and B with a smooth blend, using an exponential function.
"""

__author__     = ['Mathias Bernhard']
__copyright__  = 'Copyright 2018 / Digital Building Technologies DBT / ETH Zurich'
__license__    = 'MIT License'
__email__      = '<bernhard@arch.ethz.ch>'

import math

a = []
# input check
if not A:
    A = []
if not B:
    B = []
if not k:
    k = 0.1

# combine values A and B into new list
for t in zip(A,B):
    v1 = t[0]
    v2 = t[1]
    res = math.exp(-k*v1) + math.exp(-k*v2)
    vr = -math.log(max(0.000001,res))/k
    a.append(vr)
# ---------- end axblend ----------
axblend_2 = AxBlend(A=axblend.a, B=axpipepoly.a, k=number_slider_3)  # -> out, a; inputs A: list, B: list; same code as axblend

# ---- group: make shell and close borders
axshell = AxShell(vals=axblend_2.a, thickness=Slider(2.5, range=0..10), side=Slider(1, range=0..1))  # -> out, a; inputs vals: list
# ---------- axshell: Python ----------
#!/usr/bin/env python2
# -*- coding: utf-8 -*-

"""
Creates a shell from the solid object.
Inputs:
    vals: field values
    thickness: thickness of shell
    side: 0=outside, 1=inside, 0.5=half/half
Output:
    a: new field values
"""

__author__     = ['Mathias Bernhard']
__copyright__  = 'Copyright 2018 / Digital Building Technologies DBT / ETH Zurich'
__license__    = 'MIT License'
__email__      = '<bernhard@arch.ethz.ch>'

# input check
if not thickness:
    thickness = 1
if not side:
    side = 0.5

a = [abs(v + (side-0.5)*thickness) - thickness/2 for v in vals]
# ---------- end axshell ----------
axcapborders = AxCapBorders(nx=axvoxelgrid.nx, ny=axvoxelgrid.ny, nz=axvoxelgrid.nz, vals=axshell.a)  # -> out, a; inputs nx: Int32, ny: Int32, nz: Int32, vals: list
# ---------- axcapborders: Python ----------
#!/usr/bin/env python2
# -*- coding: utf-8 -*-

"""
caps the voxel space borders to create a closed mesh
"""

__author__     = ['Mathias Bernhard']
__copyright__  = 'Copyright 2018 / Digital Building Technologies DBT / ETH Zurich'
__license__    = 'MIT License'
__email__      = '<bernhard@arch.ethz.ch>'

import rhinoscriptsyntax as rs

def get_index(x,y,z):
    return x * nyz + y * nz + z

# input check
if not nx:
    nx = 0
if not ny:
    ny = 0
if not nz:
    nz = 0

nyz = ny * nz

a = [d for d in vals]
val = 99999.9

for u in range(nx):
    for v in range(ny):
        ia = get_index(u,v,0)
        ib = get_index(u,v,nz-1)
        a[ia] = val
        a[ib] = val

for v in range(ny):
    for w in range(nz):
        ia = get_index(0,v,w)
        ib = get_index(nx-1,v,w)
        a[ia] = val
        a[ib] = val

for w in range(nz):
    for u in range(nx):
        ia = get_index(u,0,w)
        ib = get_index(u,ny-1,w)
        a[ia] = val
        a[ib] = val
# ---------- end axcapborders ----------

# ----
axisosurface = AxIsosurface(box=axvoxelgrid.wbox, a=axcapborders.a, nx=axvoxelgrid.nx, ny=axvoxelgrid.ny, nz=axvoxelgrid.nz)  # -> out, A; inputs box: Box, a: list of Double, nx: Int32, ny: Int32, nz: Int32
# ---------- axisosurface: C# ----------
    Mesh m = marchingCubesMesh(nx, ny, nz, a, 0.0);
    double dx = box.X[1] - box.X[0];
    double dy = box.Y[1] - box.Y[0];
    double dz = box.Z[1] - box.Z[0];
    //scale the mesh to fill the box
    Transform ts = Transform.Scale(Plane.WorldXY, dx / (nx - 1), dy / (ny - 1), dz / (nz - 1));
    m.Transform(ts);
    // move the mesh to be within the box
    Transform tl = Transform.Translation(box.X[0], box.Y[0], box.Z[0]);
    m.Transform(tl);
    
    A = m;
# ---------- axisosurface: C# additional code ----------
  public Mesh marchingCubesMesh(int nX, int nY, int nZ, List<double> values, double iso) {
    Mesh mesh = new Mesh();
    int nYZ = nY * nZ;
    int nVs = 0;
    int index = 0;
    double[] nbs = new double[8];
    int[] edges = new int[12];
    int[,] xEdges = new int[nY, nZ];
    int[,] yEdges = new int[nY, nZ];
    int[,] zEdges = new int[nY, nZ];
    int[,] yEdgesUp = new int[nY, nZ];
    int[,] zEdgesUp = new int[nY, nZ];

    // first pass: all have to be calculated
    // second pass: 2 becomes 1

    for (int x = 0; x < nX - 1; x++) {
      if (x == 0) {
        for (int y = 0; y < nY; y++) {
          for (int z = 0; z < nZ; z++) {
            index = z + y * nZ + x * nYZ;
            double cV = values[index];

            if (y < nY - 1) {
              double yNb = values[index + nZ];
              if (isBorder(cV, yNb, iso)) {
                mesh.Vertices.Add(x, getValue(iso, cV, yNb) + y, z);
                yEdges[y, z] = nVs;
                nVs++;
              }
            }
            if (z < nZ - 1) {
              double zNb = values[index + 1];
              if (isBorder(cV, zNb, iso)) {
                mesh.Vertices.Add(x, y, getValue(iso, cV, zNb) + z);
                zEdges[y, z] = nVs;
                nVs++;
              }
            }
          }
        }
      } else {
        // collecting the Vertices and Edges
        copyValuesFromAToB(yEdgesUp, yEdges);
        copyValuesFromAToB(zEdgesUp, zEdges);
      }
      for (int y = 0; y < nY; y++) {
        for (int z = 0; z < nZ; z++) {
          index = z + y * nZ + x * nYZ;
          double cV = values[index];

          double xNb = values[index + nYZ];
          if (isBorder(cV, xNb, iso)) {
            mesh.Vertices.Add(getValue(iso, cV, xNb) + x, y, z);
            xEdges[y, z] = nVs;
            nVs++;
          }

          index += nYZ;
          cV = values[index];

          if (y < nY - 1) {
            double yNb = values[index + nZ];
            if (isBorder(cV, yNb, iso)) {
              mesh.Vertices.Add(x + 1, getValue(iso, cV, yNb) + y, z);
              yEdgesUp[y, z] = nVs;
              nVs++;
            }
          }
          if (z < nZ - 1) {
            double zNb = values[index + 1];
            if (isBorder(cV, zNb, iso)) {
              mesh.Vertices.Add(x + 1, y, getValue(iso, cV, zNb) + z);
              zEdgesUp[y, z] = nVs;
              nVs++;
            }
          }
        }
      }

      // collecting the faces
      for (int y = 0; y < nY - 1; y++) {
        for (int z = 0; z < nZ - 1; z++) {
          int caseNumber = 0;
          index = z + y * nZ + x * nYZ;
          nbs[0] = values[index + nZ];
          nbs[1] = values[index + nYZ + nZ];
          nbs[2] = values[index + nYZ];
          nbs[3] = values[index];
          nbs[4] = values[index + nZ + 1];
          nbs[5] = values[index + nYZ + nZ + 1];
          nbs[6] = values[index + nYZ + 1];
          nbs[7] = values[index + 1];
          for (int i = 7; i > -1; i--) {
            if (nbs[i] > iso) {
              caseNumber++;
            }
            if (i > 0) {
              caseNumber = caseNumber << 1;
            }
          }

          edges[0] = xEdges[y + 1, z];
          edges[1] = yEdgesUp[y, z];
          edges[2] = xEdges[y, z];
          edges[3] = yEdges[y, z];

          edges[4] = xEdges[y + 1, z + 1];
          edges[5] = yEdgesUp[y, z + 1];
          edges[6] = xEdges[y, z + 1];
          edges[7] = yEdges[y, z + 1];

          edges[8] = zEdges[y + 1, z];
          edges[9] = zEdgesUp[y + 1, z];
          edges[10] = zEdges[y, z];
          edges[11] = zEdgesUp[y, z];

          int offset = caseNumber * 15;

          for (int i = offset; i < offset + 15; i += 3) {
            if (faces[i] > -1) {
              MeshFace fc = new MeshFace();

              fc.A = edges[faces[i + 0]];
              fc.B = edges[faces[i + 1]];
              fc.C = edges[faces[i + 2]];
              fc.D = fc.C;
              if (fc.IsTriangle){
                mesh.Faces.AddFace(fc);
              }
            }
          }
        }
      }
    }
    mesh.Normals.ComputeNormals();
    mesh.Compact();
    return mesh;
  }

  private void copyValuesFromAToB(int[,] array1, int[,] array2) {
    for (int i = 0; i < array1.GetLength(0); i++) {
      for (int j = 0; j < array1.GetLength(1); j++) {
        array2[i, j] = array1[i, j];
      }
    }
  }

  private double getValue(double iso, double v1, double v2) {
    if (Math.Abs(v2 - v1) < 0.0000001f) {
      return 0;
    }
    return (iso - v1) / (v2 - v1);
  }

  private bool isBorder(double v1, double v2, double iso){
    if (v1 > iso && v2 <= iso)return true;
    if (v2 > iso && v1 <= iso)return true;
    return false;
  }

  private static int[] faces = new int[] {
    -1, -1, -1, -1, -1, -1, -1, -1, -1, -1, -1,-1, -1, -1, -1,
    0, 8, 3, -1, -1, -1, -1, -1, -1, -1, -1, -1, -1,-1, -1,
    0, 1, 9, -1, -1, -1, -1, -1, -1, -1, -1, -1, -1, -1, -1,
    1,8, 3, 9, 8, 1, -1, -1, -1, -1, -1, -1, -1, -1, -1,
    1, 2, 11, -1,-1, -1, -1, -1, -1, -1, -1, -1, -1, -1, -1,
    0, 8, 3, 1, 2, 11, -1,-1, -1, -1, -1, -1, -1, -1, -1,
    9, 2, 11, 0, 2, 9, -1, -1, -1, -1,
    -1, -1, -1, -1, -1, 2, 8, 3, 2, 11, 8, 11, 9, 8, -1, -1, -1, -1,
    -1, -1, 3, 10, 2, -1, -1, -1, -1, -1, -1, -1, -1, -1, -1, -1, -1,
    0, 10, 2, 8, 10, 0, -1, -1, -1, -1, -1, -1, -1, -1, -1, 1, 9, 0, 2,
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# ---------- end axisosurface ----------
preview = CustomPreview(
    Geometry=axisosurface.A,
    Shader={ambient=RGB(0, 0, 0), diffuse=RGB(255, 105, 180), emission=RGB(76, 32, 54), shine=0.5, specular=RGB(255, 255, 255), transparency=0})

# ==== cluster AxVoxelGrid: Creates the initial grid of voxels. Outputs number of cells in X, Y and Z and a list of query points.
box = ClusterInput()
box_corners = BoxCorners(Box=box)  # -> CornerA, CornerB, CornerC, CornerD, CornerE, CornerF, CornerG, CornerH
dim = ClusterInput()
bbox = BoundingBox(
    Content=[box_corners.CornerA, box_corners.CornerB, box_corners.CornerC, box_corners.CornerD, box_corners.CornerE, box_corners.CornerF, box_corners.CornerG, box_corners.CornerH],
    Plane=PlaneXY(0, 0, 0),
    UnionBox=True)  # -> wBox, B
c_script = CSharpScript(Box=bbox.wBox, dim=dim)  # -> out, nx, ny, nz, pts; inputs Box: Box, dim: Double
# ---------- c_script: C# ----------
    double dx = Box.X[1] - Box.X[0];
    double dy = Box.Y[1] - Box.Y[0];
    double dz = Box.Z[1] - Box.Z[0];

    int nxt = (int) Math.Round(dx / dim)+1;
    int nyt = (int) Math.Round(dy / dim)+1;
    int nzt = (int) Math.Round(dz / dim)+1;

    double dimx = dx / (nxt - 1);
    double dimy = dy / (nyt - 1);
    double dimz = dz / (nzt - 1);

    nx = nxt;
    ny = nyt;
    nz = nzt;

    Point3d[] res = new Point3d[nxt * nyt * nzt];
    int i = 0;
    for (int x = 0; x < nxt; x++) {
      for (int y = 0; y < nyt; y++) {
        for (int z = 0; z < nzt; z++) {
          double px = Box.Center[0] - dx / 2 + x * dimx;
          double py = Box.Center[1] - dy / 2 + y * dimy;
          double pz = Box.Center[2] - dz / 2 + z * dimz;
          res[i] = new Point3d(px, py, pz);
          i++;
        }
      }
    }
    pts = res;
# ---------- c_script: C# additional code ----------
  /// <summary>
  /// This method will be called once every solution, before any calls to RunScript.
  /// </summary>
  public override void BeforeRunScript()
  { }
  /// <summary>
  /// This method will be called once every solution, after any calls to RunScript.
  /// </summary>
  public override void AfterRunScript()
  { }
# ---------- end c_script ----------
wbox = ClusterOutput(bbox.wBox)
nx = ClusterOutput(c_script.nx)
ny = ClusterOutput(c_script.ny)
nz = ClusterOutput(c_script.nz)
pts = ClusterOutput(c_script.pts)
